# Grasshopper definition datacache_to_model.gh (Grasshopper 1.0.8)

panel = Panel("""concrete
metal
wood
brick
glass
quartz
granite
stone
gypsum
plastic
tile
carpet
other""")
path = FilePath("G:\My Drive\GSD_AI\05_Segmentation\17DRP5sb8fy\PreProcessedFrameData\")
path_2 = FilePath("C:\GSD_tmp\")
c__getjsonpaths = CSharpScript(SearchDir=path)  # -> out, Paths; inputs SearchDir: String
# ---------- c__getjsonpaths: C# ----------
// Grasshopper Script Instance
#region Usings
using System;
using System.Linq;
using System.Collections;
using System.Collections.Generic;
using System.Drawing;

using Rhino;
using Rhino.Geometry;

using Grasshopper;
using Grasshopper.Kernel;
using Grasshopper.Kernel.Data;
using Grasshopper.Kernel.Types;
#endregion

public class Script_Instance : GH_ScriptInstance
{
    #region Notes
    /* 
      Members:
        RhinoDoc RhinoDocument
        GH_Document GrasshopperDocument
        IGH_Component Component
        int Iteration

      Methods (Virtual & overridable):
        Print(string text)
        Print(string format, params object[] args)
        Reflect(object obj)
        Reflect(object obj, string method_name)
    */
    #endregion

    private void RunScript(string SearchDir, ref object Paths)
    {

        Paths = System.IO.Directory.GetFiles(SearchDir, "*.json");
    }
}
# ---------- end c__getjsonpaths ----------
merge = Merge(
    Data1=ColourSwatch(SwatchColor=RGB(0, 255, 255)),
    Data2=ColourSwatch(SwatchColor=RGB(255, 0, 255)),
    Data3=ColourSwatch(SwatchColor=RGB(0, 0, 255)),
    Data4=ColourSwatch(SwatchColor=RGB(255, 255, 159)),
    Data5=ColourSwatch(SwatchColor=RGB(100, 68, 168)),
    Data6=ColourSwatch(SwatchColor=RGB(74, 121, 148)),
    Data7=ColourSwatch(SwatchColor=RGB(0, 255, 0)),
    Data8=ColourSwatch(SwatchColor=RGB(255, 0, 0)),
    Data9=ColourSwatch(SwatchColor=RGB(255, 255, 0)),
    Data10=ColourSwatch(SwatchColor=RGB(146, 0, 118)),
    Data11=ColourSwatch(SwatchColor=RGB(19, 131, 115)),
    Data12=ColourSwatch(SwatchColor=RGB(232, 92, 129)),
    Data13=ColourSwatch(SwatchColor=RGB(72, 67, 93)))
item = ListItem(List=c__getjsonpaths.Paths, Index=0, Wrap=True)
lng = ListLength(List=c__getjsonpaths.Paths)
number_slider = Slider(60, range=0..60)
series = Series(Start=0, Step=1, Count=lng)

# ---- group: Verification
c__jsonin = CSharpScript(JsonPath=c__getjsonpaths.Paths)  # -> out, DepthImgPath, RgbImgPath, SegmentImgPath, MaskImgPath, OutlineImgPath, CameraTransform, FocalLengthXPx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; inputs JsonPath: String
# ---------- c__jsonin: C# ----------
// Grasshopper Script Instance
#region Usings
using System;
using System.Linq;
using System.Collections;
using System.Collections.Generic;
using System.Drawing;

using Rhino;
using Rhino.Geometry;

using Grasshopper;
using Grasshopper.Kernel;
using Grasshopper.Kernel.Data;
using Grasshopper.Kernel.Types;

using System.Text.Json;
using System.IO;
#endregion

public class Script_Instance : GH_ScriptInstance
{
    #region Notes
    /* 
      Members:
        RhinoDoc RhinoDocument
        GH_Document GrasshopperDocument
        IGH_Component Component
        int Iteration

      Methods (Virtual & overridable):
        Print(string text)
        Print(string format, params object[] args)
        Reflect(object obj)
        Reflect(object obj, string method_name)
    */
    #endregion

    private void RunScript(
	string JsonPath,
	ref object DepthImgPath,
	ref object RgbImgPath,
	ref object SegmentImgPath,
	ref object MaskImgPath,
	ref object OutlineImgPath,
	ref object CameraTransform,
	ref object FocalLengthXPx,
	ref object OpticalCenterXPx,
	ref object OpticalCenterYPx,
	ref object ImgWidth,
	ref object ImgHeight,
	ref object ImgScaleFactor,
	ref object LabeledMeshIdsFaceIdsWithCt,
	ref object Label,
	ref object OriginalDescription)
    {
        FrameData data;
        using (StreamReader r = new StreamReader(JsonPath))
        {
            string jsonStr = r.ReadToEnd();
            var dataList = (List<FrameData>)JsonSerializer.Deserialize(jsonStr, typeof(List<FrameData>), new JsonSerializerOptions());
            data = dataList[0];
        }
        DepthImgPath = data.DepthImgPath;
        RgbImgPath = data.RgbImgPath;
        SegmentImgPath = data.SegmentImgPath;
        MaskImgPath = data.MaskImgPath;
        OutlineImgPath = data.OutlineImgPath;
        CameraTransform = MatrixToTransform(data.CameraTransformMatrix);
        FocalLengthXPx = data.FocalLengthXPx;
        OpticalCenterXPx = data.OpticalCenterXPx;
        OpticalCenterYPx = data.OpticalCenterYPx;
        ImgWidth = data.ImgWidth;
        ImgHeight = data.ImgHeight;
        ImgScaleFactor = data.ImgScaleFactor;
        LabeledMeshIdsFaceIdsWithCt = DictToTree(data.LabeledMeshIdsFaceIdsWithCt);
        Label = data.Label;
        OriginalDescription = data.OriginalDescription;
    }

    private Transform MatrixToTransform(double[] transformMatrix)
    {
        Transform t = Transform.Identity;

        for(int r = 0; r < 4; r++) for(int c = 0; c < 4; c++)
        {
            int i = r * 4 + c;
            t[r, c] = transformMatrix[i];
        }

        return t;
    }

    private DataTree<int> DictToTree(Dictionary<int, Dictionary<int, int>> dict)
    {
        DataTree<int> dataTree = new DataTree<int>();
        foreach(int meshIdx in dict.Keys)
        {
            foreach(int faceIdx in dict[meshIdx].Keys)
            {
                GH_Path path = new GH_Path(new int[] {Iteration, meshIdx, faceIdx});
                List<int> ct = dataTree.EnsurePath(path);
                ct.Add(dict[meshIdx][faceIdx]);//should only be one value in the target tree branch since it is a total.
            }
        }
        return dataTree;
    }

    private class FrameData
    {
        public string DepthImgPath {get;set;}
        public string RgbImgPath {get;set;}
        public string SegmentImgPath {get;set;}
        public string MaskImgPath {get;set;}
        public string OutlineImgPath {get;set;}
        public double[] CameraTransformMatrix {get;set;}
        public double FocalLengthXPx {get;set;}
        public double OpticalCenterXPx {get;set;}
        public double OpticalCenterYPx {get;set;}
        public int ImgWidth {get;set;}
        public int ImgHeight {get;set;}
        public double ImgScaleFactor {get;set;}
        public Dictionary<int, Dictionary<int, int>> LabeledMeshIdsFaceIdsWithCt {get;set;}
        public string Label {get;set;}
        public string OriginalDescription {get;set;}
    }
}
# ---------- end c__jsonin ----------
c__transformcameras2 = CSharpScript(
    FocalLengthXPx=c__jsonin.FocalLengthXPx,
    OpticalCenterXPx=c__jsonin.OpticalCenterXPx,
    OpticalCenterYPx=c__jsonin.OpticalCenterYPx,
    ImgWidth=c__jsonin.ImgWidth,
    ImgHeight=c__jsonin.ImgHeight,
    ScaleFactor=c__jsonin.ImgScaleFactor,
    CameraTransform=c__jsonin.CameraTransform)  # -> out, simplify(CameraPreviewGeom), ImgFrame, CameraPosition, CameraTarget, CameraDir; inputs FocalLengthXPx: Double, OpticalCenterXPx: Double, OpticalCenterYPx: Double, ImgWidth: Int32, ImgHeight: Int32, ScaleFactor: Double, CameraTransform: Transform
# ---------- c__transformcameras2: C# ----------
// Grasshopper Script Instance
#region Usings
using System;
using System.Linq;
using System.Collections;
using System.Collections.Generic;
using System.Drawing;

using Rhino;
using Rhino.Geometry;

using Grasshopper;
using Grasshopper.Kernel;
using Grasshopper.Kernel.Data;
using Grasshopper.Kernel.Types;
#endregion

public class Script_Instance : GH_ScriptInstance
{
    #region Notes
    /* 
      Members:
        RhinoDoc RhinoDocument
        GH_Document GrasshopperDocument
        IGH_Component Component
        int Iteration

      Methods (Virtual & overridable):
        Print(string text)
        Print(string format, params object[] args)
        Reflect(object obj)
        Reflect(object obj, string method_name)
    */
    #endregion

    private void RunScript(
	double FocalLengthXPx,
	double OpticalCenterXPx,
	double OpticalCenterYPx,
	int ImgWidth,
	int ImgHeight,
	double ScaleFactor,
	Transform CameraTransform,
	ref object CameraPreviewGeom,
	ref object ImgFrame,
	ref object CameraPosition,
	ref object CameraTarget,
	ref object CameraDir)
    {
        Rectangle3d rect = new Rectangle3d(Plane.WorldXY, Plane.WorldXY.Origin, new Point3d(ImgWidth, ImgHeight, 0));
        Vector3d tX = Vector3d.XAxis * -1 * OpticalCenterXPx;
        Vector3d tY = Vector3d.YAxis * -1 * OpticalCenterYPx;
        Vector3d tZ = Vector3d.ZAxis * -1 * FocalLengthXPx;
        Vector3d t = tX + tY + tZ;
        Print(t.ToString());
        Transform translate = Transform.Translation(t);
        rect.Transform(translate);
        Point3d o = Plane.WorldXY.Origin;
        Line e0 = new Line(o, rect.Corner(0));
        Line e1 = new Line(o, rect.Corner(1));
        Line e2 = new Line(o, rect.Corner(2));
        Line e3 = new Line(o, rect.Corner(3));
        Line cam = new Line(o, tZ);
        List<Line> previewGeom = new List<Line>(){e0, e1, e2, e3, cam};
        Transform scale = Transform.Scale(o, ScaleFactor);

        rect.Transform(scale);
        rect.Transform(CameraTransform);

        previewGeom = TransformLines(previewGeom, scale);// previewGeom.ForEach(x => x.Transform(scale));
        previewGeom = TransformLines(previewGeom, CameraTransform);//previewGeom.ForEach(x => x.Transform(CameraTransform));
        Point3d cP = previewGeom[4].From;
        Point3d cT = previewGeom[4].To;
        Vector3d cD = cT - cP;
        cD.Unitize();

        CameraPreviewGeom = previewGeom;
        ImgFrame = rect;
        CameraPosition = cP;
        CameraTarget = cT;
        CameraDir = cD;
    }


    private List<Line> TransformLines(List<Line> lines, Transform t)
    {
        List<Line> transformed = new List<Line>();
        foreach(var line in lines)
        {
            line.Transform(t);
            transformed.Add(line);
        }
        return transformed;
    }
}
# ---------- end c__transformcameras2 ----------

# ----
# For each mesh face:
# set of labels
c__combineframes = CSharpScript(LabeledMeshFaces=c__jsonin.LabeledMeshIdsFaceIdsWithCt, Labels=c__jsonin.Label)  # -> out, CombinedLabeledFaces; inputs LabeledMeshFaces: tree of Int32, Labels: list of String; disabled
# ---------- c__combineframes: C# ----------
// Grasshopper Script Instance
#region Usings
using System;
using System.Linq;
using System.Collections;
using System.Collections.Generic;
using System.Drawing;

using Rhino;
using Rhino.Geometry;

using Grasshopper;
using Grasshopper.Kernel;
using Grasshopper.Kernel.Data;
using Grasshopper.Kernel.Types;
#endregion

public class Script_Instance : GH_ScriptInstance
{
    #region Notes
    /* 
      Members:
        RhinoDoc RhinoDocument
        GH_Document GrasshopperDocument
        IGH_Component Component
        int Iteration

      Methods (Virtual & overridable):
        Print(string text)
        Print(string format, params object[] args)
        Reflect(object obj)
        Reflect(object obj, string method_name)
    */
    #endregion

    private void RunScript(
	DataTree<int> LabeledMeshFaces,
	List<string> Labels,
	ref object CombinedLabeledFaces)
    {
        DataTree<string> combinedLabeledFaces = new DataTree<string>();
        foreach(var path in LabeledMeshFaces.Paths)
        {
            //Print(path.ToString());
            int[] indices = path.Indices;
            if (indices.Length != 3)
            {
                Print("Unexpected path length");
                return;
            }
            int frameIdx = indices[0];
            int meshIdx = indices[1];
            int faceIdx = indices[2];
            //if (meshIdx == 6) Print("Mesh Idx: " + meshIdx.ToString() + " FaceIdx" + faceIdx.ToString());
            GH_Path addPath = new GH_Path(new int[] {meshIdx, faceIdx});
            List<string> labels = combinedLabeledFaces.EnsurePath(addPath);
            for (int i = 0; i < LabeledMeshFaces.Branch(path)[0]; i++)
            {
                labels.Add(Labels[frameIdx]);
            }
        }
        CombinedLabeledFaces = combinedLabeledFaces;
    }
}
# ---------- end c__combineframes ----------
c__combineframesandvote = CSharpScript(LabeledMeshFaces=c__jsonin.LabeledMeshIdsFaceIdsWithCt, Labels=c__jsonin.Label)  # -> out, CombinedLabeledFaces, CombinedLabeledFacesScores; inputs LabeledMeshFaces: tree of Int32, Labels: list of String; disabled
# ---------- c__combineframesandvote: C# ----------
// Grasshopper Script Instance
#region Usings
using System;
using System.Linq;
using System.Collections;
using System.Collections.Generic;
using System.Drawing;

using Rhino;
using Rhino.Geometry;

using Grasshopper;
using Grasshopper.Kernel;
using Grasshopper.Kernel.Data;
using Grasshopper.Kernel.Types;
#endregion

public class Script_Instance : GH_ScriptInstance
{
    #region Notes
    /* 
      Members:
        RhinoDoc RhinoDocument
        GH_Document GrasshopperDocument
        IGH_Component Component
        int Iteration

      Methods (Virtual & overridable):
        Print(string text)
        Print(string format, params object[] args)
        Reflect(object obj)
        Reflect(object obj, string method_name)
    */
    #endregion

    private void RunScript(
	DataTree<int> LabeledMeshFaces,
	List<string> Labels,
	ref object CombinedLabeledFaces,
	ref object CombinedLabeledFacesScores)
    {
        
        var collectedLabels = new Dictionary<int, Dictionary<int, Dictionary<string, int>>>(); //{meshIdx, {faceIdx, {label, count}}}
        foreach(var path in LabeledMeshFaces.Paths)
        {
            int[] indices = path.Indices;
            if (indices.Length != 3)
            {
                Print("Unexpected path length");
                return;
            }
            int frameIdx = indices[0];
            int meshIdx = indices[1];
            int faceIdx = indices[2];
            string label = Labels[frameIdx];
            if (!collectedLabels.ContainsKey(meshIdx)) collectedLabels.Add(meshIdx, new Dictionary<int, Dictionary<string, int>>());
            if (!collectedLabels[meshIdx].ContainsKey(faceIdx)) collectedLabels[meshIdx].Add(faceIdx, new Dictionary<string, int>());
            if (!collectedLabels[meshIdx][faceIdx].ContainsKey(label)) collectedLabels[meshIdx][faceIdx].Add(label, 0);
            collectedLabels[meshIdx][faceIdx][label] += LabeledMeshFaces.Branch(path)[0];
            // GH_Path addPath = new GH_Path(new int[] {meshIdx, faceIdx});
            // List<string> labels = combinedLabeledFaces.EnsurePath(addPath);
            // for (int i = 0; i < LabeledMeshFaces.Branch(path)[0]; i++)
            // {
            //     labels.Add(Labels[frameIdx]);
            // }
        }

        DataTree<string> combinedLabeledFaces = new DataTree<string>();
        DataTree<int> combinedLabeledFacesScores = new DataTree<int>();
        foreach(int meshIdx in collectedLabels.Keys)
        {
            foreach(int faceIdx in collectedLabels[meshIdx].Keys)
            {
                var dictList = collectedLabels[meshIdx][faceIdx].ToList();
                dictList = dictList.OrderByDescending(kvp => kvp.Value).ToList();
                GH_Path path = new GH_Path(meshIdx, faceIdx);
                List<string> label = combinedLabeledFaces.EnsurePath(path);
                label.Add(dictList[0].Key);
                List<int> score = combinedLabeledFacesScores.EnsurePath(path);
                score.Add(dictList[0].Value);
            }
        }
        
        CombinedLabeledFaces = combinedLabeledFaces;
        CombinedLabeledFacesScores = combinedLabeledFacesScores;
    }
}
# ---------- end c__combineframesandvote ----------
multiplication = Multiplication(A=c__jsonin.ImgScaleFactor, B=10)
concat = Concatenate(FragmentA=c__jsonin.OriginalDescription, FragmentB=",", FragmentC=c__jsonin.Label)
panel_2 = Panel(c__jsonin.RgbImgPath)
path_3 = FilePath("G:\My Drive\GSD_AI\05_Segmentation\17DRP5sb8fy\VideoProduction\")
pt = ConstructPoint(XCoordinate=0, YCoordinate=0, ZCoordinate=0)
c__sortframes = CSharpScript(RgbImgPaths=c__jsonin.RgbImgPath, CameraPositions=c__transformcameras2.CameraPosition, SortingPoint=pt)  # -> out, AveragePoints, SortedFrameOrder; inputs RgbImgPaths: list of String, CameraPositions: list of Point3d, SortingPoint: Point3d
# ---------- c__sortframes: C# ----------
// Grasshopper Script Instance
#region Usings
using System;
using System.Linq;
using System.Collections;
using System.Collections.Generic;
using System.Drawing;

using Rhino;
using Rhino.Geometry;

using Grasshopper;
using Grasshopper.Kernel;
using Grasshopper.Kernel.Data;
using Grasshopper.Kernel.Types;

using System.IO;
#endregion

public class Script_Instance : GH_ScriptInstance
{
    #region Notes
    /* 
      Members:
        RhinoDoc RhinoDocument
        GH_Document GrasshopperDocument
        IGH_Component Component
        int Iteration

      Methods (Virtual & overridable):
        Print(string text)
        Print(string format, params object[] args)
        Reflect(object obj)
        Reflect(object obj, string method_name)
    */
    #endregion

    private void RunScript(
	List<string> RgbImgPaths,
	List<Point3d> CameraPositions,
	Point3d SortingPoint,
	ref object AveragePoints,
	ref object SortedFrameOrder)
    {
        //desired order:
        //keep each main position and order (which contains 3 sets of 6 images) together
        //order the main positions by some method

        var mainPositionsWithFrames = new Dictionary<string, SortedDictionary<string, SortedDictionary<string, Tuple<List<int>, List<Point3d>>>>>();//sorting is necessary to keep order of images at tripods correct and not random
        //var mainPositions = new Dictionary<string, Point3d>();
        if (RgbImgPaths.Count != CameraPositions.Count)
        {
            Component.AddRuntimeMessage(GH_RuntimeMessageLevel.Error, "List lengths do not match");
            return;
        }

        for (int i = 0; i < RgbImgPaths.Count; i++)
        {
            string path = RgbImgPaths[i];
            Point3d pos = CameraPositions[i];
            string fileName = Path.GetFileNameWithoutExtension(path);
            string[] nameComponents = fileName.Split(new char[] {'_'});
            if (nameComponents.Length != 3)
            {
                Component.AddRuntimeMessage(GH_RuntimeMessageLevel.Error, "Unexpected naming structure to RGB image file path");
                return;
            }
            string mainKey = nameComponents[0];
            string secondaryKey = nameComponents[1];
            string tertiaryKey = nameComponents[2];


            if (!mainPositionsWithFrames.ContainsKey(mainKey)) mainPositionsWithFrames.Add(mainKey, new SortedDictionary<string, SortedDictionary<string, Tuple<List<int>, List<Point3d>>>>());
            if (!mainPositionsWithFrames[mainKey].ContainsKey(secondaryKey)) mainPositionsWithFrames[mainKey].Add(secondaryKey, new SortedDictionary<string, Tuple<List<int>, List<Point3d>>>());
            if (!mainPositionsWithFrames[mainKey][secondaryKey].ContainsKey(tertiaryKey))mainPositionsWithFrames[mainKey][secondaryKey].Add(tertiaryKey, Tuple.Create(new List<int>(), new List<Point3d>()));
            mainPositionsWithFrames[mainKey][secondaryKey][tertiaryKey].Item1.Add(i);
            mainPositionsWithFrames[mainKey][secondaryKey][tertiaryKey].Item2.Add(pos);
        }

        //average points for the main positions so there is one sorting point.
        var sortingList = new List<Tuple<List<int>, Point3d>>();
        foreach(var mainKey in mainPositionsWithFrames.Keys)
        {
            int c = 0;
            Point3d sumPt = new Point3d(0,0,0);
            List<int> collectedFrames = new List<int>();
            foreach(var secondaryKey in mainPositionsWithFrames[mainKey].Keys)
            {
                foreach(var tertiaryKey in mainPositionsWithFrames[mainKey][secondaryKey].Keys)
                {
                    mainPositionsWithFrames[mainKey][secondaryKey][tertiaryKey].Item2.ForEach(pos => 
                    {
                        sumPt += pos;
                        c++;
                    });
                    collectedFrames.AddRange(mainPositionsWithFrames[mainKey][secondaryKey][tertiaryKey].Item1);
                }
            }
            Point3d avgPt = sumPt / c;
            sortingList.Add(Tuple.Create(collectedFrames, avgPt));
        }

        sortingList = sortingList.OrderBy(t => t.Item2.DistanceTo(SortingPoint)).ThenBy(t => {
            Vector3d dir = t.Item2 - SortingPoint;
            return Vector3d.VectorAngle(Plane.WorldXY.XAxis, new Vector3d(dir.X, dir.Y, 0));
            }).ToList();

        
        // sortingList = sortingList.OrderBy(t => {
        //     Vector3d dir = t.Item2 - SortingPoint;
        //     return Vector3d.VectorAngle(Plane.WorldXY.XAxis, new Vector3d(dir.X, dir.Y, 0));
        //     }).ThenBy(t => t.Item2.DistanceTo(SortingPoint)).ToList();
        SortedFrameOrder = sortingList.SelectMany(t => t.Item1).ToList();
        AveragePoints = sortingList.Select(t => t.Item2).ToList();






    }
}
# ---------- end c__sortframes ----------
item_2 = ListItem(List=concat, Index=graft(c__sortframes.SortedFrameOrder), Wrap=True)  # -> flatten(Item)
item_3 = ListItem(List=c__jsonin.OutlineImgPath, Index=graft(c__sortframes.SortedFrameOrder), Wrap=True)  # -> flatten(Item)
item_4 = ListItem(List=c__jsonin.Label, Index=graft(c__sortframes.SortedFrameOrder), Wrap=True)  # -> flatten(Item)
item_5 = ListItem(List=c__jsonin.DepthImgPath, Index=graft(c__sortframes.SortedFrameOrder), Wrap=True)  # -> flatten(Item)
item_6 = ListItem(List=c__jsonin.MaskImgPath, Index=graft(c__sortframes.SortedFrameOrder), Wrap=True)  # -> flatten(Item)
item_7 = ListItem(List=c__jsonin.RgbImgPath, Index=graft(c__sortframes.SortedFrameOrder), Wrap=True)  # -> flatten(Item)
item_8 = ListItem(List=c__jsonin.SegmentImgPath, Index=graft(c__sortframes.SortedFrameOrder), Wrap=True)  # -> flatten(Item)
item_9 = ListItem(List=c__sortframes.SortedFrameOrder, Index=Slider(0, range=0..8957), Wrap=True)
path_4 = ConstructPath(Indices=item_9)
c__reordermeshfacestree = CSharpScript(LabeledMeshFaces=c__jsonin.LabeledMeshIdsFaceIdsWithCt, FrameOrder=c__sortframes.SortedFrameOrder)  # -> out, ReorderedLabeledMeshFaces; inputs LabeledMeshFaces: tree of Int32, FrameOrder: list of Int32; disabled
# ---------- c__reordermeshfacestree: C# ----------
// Grasshopper Script Instance
#region Usings
using System;
using System.Linq;
using System.Collections;
using System.Collections.Generic;
using System.Drawing;

using Rhino;
using Rhino.Geometry;

using Grasshopper;
using Grasshopper.Kernel;
using Grasshopper.Kernel.Data;
using Grasshopper.Kernel.Types;
#endregion

public class Script_Instance : GH_ScriptInstance
{
    #region Notes
    /* 
      Members:
        RhinoDoc RhinoDocument
        GH_Document GrasshopperDocument
        IGH_Component Component
        int Iteration

      Methods (Virtual & overridable):
        Print(string text)
        Print(string format, params object[] args)
        Reflect(object obj)
        Reflect(object obj, string method_name)
    */
    #endregion

    private void RunScript(
	DataTree<int> LabeledMeshFaces,
	List<int> FrameOrder,
	ref object ReorderedLabeledMeshFaces)
    {
        DataTree<int> reordered = new DataTree<int>();

        foreach(GH_Path path in LabeledMeshFaces.Paths)
        {
            if (path.Indices.Length != 3)
            {
                Component.AddRuntimeMessage(GH_RuntimeMessageLevel.Error, "Unexpected tree structure");
                return;
            }
            int newFrame = FrameOrder.IndexOf(path[0]);
            if (newFrame == -1)
            {
                Component.AddRuntimeMessage(GH_RuntimeMessageLevel.Error, "Frame not found in new frame order list");
                return;
            }
            GH_Path newPath = new GH_Path(new int[] {newFrame, path[1], path[2]});
            List<int> branch = reordered.EnsurePath(newPath);
            branch.AddRange(LabeledMeshFaces.Branch(path));
        }

        ReorderedLabeledMeshFaces = reordered;
    }
}
# ---------- end c__reordermeshfacestree ----------
item_10 = ListItem(List=c__sortframes.SortedFrameOrder, Index=Slider(8958, range=0..8958), Wrap=True)
branch = TreeBranch(Tree=c__transformcameras2.CameraPreviewGeom, Path=path_4, MaintainPaths=True)
c__writetexttofile = CSharpScript(WriteDir=path_3, FileName="AnimationRgb", Txt=item_7)  # -> out; inputs WriteDir: String, FileName: String, Txt: list of String; disabled
# ---------- c__writetexttofile: C# ----------
// Grasshopper Script Instance
#region Usings
using System;
using System.Linq;
using System.Collections;
using System.Collections.Generic;
using System.Drawing;

using Rhino;
using Rhino.Geometry;

using Grasshopper;
using Grasshopper.Kernel;
using Grasshopper.Kernel.Data;
using Grasshopper.Kernel.Types;

using System.IO;
#endregion

public class Script_Instance : GH_ScriptInstance
{
    #region Notes
    /* 
      Members:
        RhinoDoc RhinoDocument
        GH_Document GrasshopperDocument
        IGH_Component Component
        int Iteration

      Methods (Virtual & overridable):
        Print(string text)
        Print(string format, params object[] args)
        Reflect(object obj)
        Reflect(object obj, string method_name)
    */
    #endregion

    private void RunScript(string WriteDir, string FileName, List<string> Txt)
    {
        File.WriteAllLines(WriteDir + FileName + ".txt", Txt);
    }
}
# ---------- end c__writetexttofile ----------
c__maskandlabelscsv = CSharpScript(MaskImgPaths=item_6, Labels=item_4, OutputDir=path_3)  # -> out; inputs MaskImgPaths: list of String, Labels: list of String, OutputDir: String; disabled
# ---------- c__maskandlabelscsv: C# ----------
// Grasshopper Script Instance
#region Usings
using System;
using System.Linq;
using System.Collections;
using System.Collections.Generic;
using System.Drawing;

using Rhino;
using Rhino.Geometry;

using Grasshopper;
using Grasshopper.Kernel;
using Grasshopper.Kernel.Data;
using Grasshopper.Kernel.Types;

using System.IO;
#endregion

public class Script_Instance : GH_ScriptInstance
{
    #region Notes
    /* 
      Members:
        RhinoDoc RhinoDocument
        GH_Document GrasshopperDocument
        IGH_Component Component
        int Iteration

      Methods (Virtual & overridable):
        Print(string text)
        Print(string format, params object[] args)
        Reflect(object obj)
        Reflect(object obj, string method_name)
    */
    #endregion

    private void RunScript(
	List<string> MaskImgPaths,
	List<string> Labels,
	string OutputDir)
    {
        if (MaskImgPaths.Count != Labels.Count)
        {
            this.AddRuntimeMessage(GH_RuntimeMessageLevel.Error, "List lengths do not match");
            return;
        }
        
        string csv = "";
        for (int i = 0; i < MaskImgPaths.Count; i++)
        {
            string path = MaskImgPaths[i];
            string label = Labels[i];
            csv += path + "," + label + "\n";
        }

        string outPath = OutputDir + "/MasksAndLabels.csv";
        File.WriteAllText(outPath, csv);
    }
}
# ---------- end c__maskandlabelscsv ----------
c__writetexttofile_2 = CSharpScript(WriteDir=path_3, FileName="AnimationDepth", Txt=item_5)  # -> out; inputs WriteDir: String, FileName: String, Txt: list of String; disabled; same code as c__writetexttofile
c__writetexttofile_3 = CSharpScript(WriteDir=path_3, FileName="AnimationSegmented", Txt=item_8)  # -> out; inputs WriteDir: String, FileName: String, Txt: list of String; disabled; same code as c__writetexttofile
c__writetexttofile_4 = CSharpScript(WriteDir=path_3, FileName="AnimationOutlines", Txt=item_3)  # -> out; inputs WriteDir: String, FileName: String, Txt: list of String; disabled; same code as c__writetexttofile
c__writetexttofile_5 = CSharpScript(WriteDir=path_3, FileName="AnimationMasked", Txt=item_6)  # -> out; inputs WriteDir: String, FileName: String, Txt: list of String; disabled; same code as c__writetexttofile
c__labelsandcolors_csv = CSharpScript(Labels=panel, Colors=merge, OutputDir=path_3)  # -> out; inputs Labels: list of String, Colors: list of Color, OutputDir: String; disabled
# ---------- c__labelsandcolors_csv: C# ----------
// Grasshopper Script Instance
#region Usings
using System;
using System.Linq;
using System.Collections;
using System.Collections.Generic;
using System.Drawing;

using Rhino;
using Rhino.Geometry;

using Grasshopper;
using Grasshopper.Kernel;
using Grasshopper.Kernel.Data;
using Grasshopper.Kernel.Types;

using System.IO;
#endregion

public class Script_Instance : GH_ScriptInstance
{
    #region Notes
    /* 
      Members:
        RhinoDoc RhinoDocument
        GH_Document GrasshopperDocument
        IGH_Component Component
        int Iteration

      Methods (Virtual & overridable):
        Print(string text)
        Print(string format, params object[] args)
        Reflect(object obj)
        Reflect(object obj, string method_name)
    */
    #endregion

    private void RunScript(
	List<string> Labels,
	List<Color> Colors,
	string OutputDir)
    {
        if (Labels.Count != Colors.Count)
        {
            this.AddRuntimeMessage(GH_RuntimeMessageLevel.Error, "List lengths do not match");
            return;
        }
        
        string csv = "";
        string d = ",";
        for (int i = 0; i < Colors.Count; i++)
        {
            string label = Labels[i];
            Color color = Colors[i];
            csv += $"{label},{color.R.ToString()},{color.G.ToString()},{color.B.ToString()}\n";
        }

        string outPath = OutputDir + "/LabelsAndColors.csv";
        File.WriteAllText(outPath, csv);
    }
}
# ---------- end c__labelsandcolors_csv ----------
c__writetexttofile_6 = CSharpScript(WriteDir=path_3, FileName="DescriptionsAndLabels", Txt=item_2)  # -> out; inputs WriteDir: String, FileName: String, Txt: list of String; disabled; same code as c__writetexttofile
panel_3 = Panel(c__sortframes.SortedFrameOrder)
referenceframe = Integer(item_10)
panel_4 = Panel(c__jsonin.OutlineImgPath)
item_11 = ListItem(List=c__transformcameras2.CameraPosition, Index=referenceframe, Wrap=True)
item_12 = ListItem(List=c__jsonin.Label, Index=referenceframe, Wrap=True)
button = Button()
ln = Line()
number_slider_2 = Slider(4, range=0..45)
number_slider_3 = Slider(0.001, range=0..0.01)  # disabled
pipe = Pipe(Curve=ln, Radius=number_slider_3, Caps=0)  # disabled
swatch = ColourSwatch(SwatchColor=RGB(255, 255, 255))  # disabled
preview = CustomPreview(Geometry=flatten(pipe), Material=swatch)  # disabled

c__gettextures = CSharpScript(InputMeshLayer="OrigMeshes")  # -> out, Meshes, Guids, Materials; inputs InputMeshLayer: String
# ---------- c__gettextures: C# usings ----------
using Rhino.DocObjects;
using Rhino.Render;
# ---------- c__gettextures: C# ----------
    RhinoDoc doc = RhinoDoc.ActiveDoc;
    List<Mesh> meshes = new List<Mesh>();
    List<object> materials = new List<object>();
    List<string> guids = new List<string>();


    RhinoObject[] meshObjects = doc.Objects.FindByLayer(InputMeshLayer);

    int i = -1;
    foreach(RhinoObject o in meshObjects)
    {
      i++;
      Mesh[] mesh = o.GetMeshes(MeshType.Any);
      if (mesh == null || mesh.Length != 1) continue;

      Material m = o.GetMaterial(true);
      if (m == null) continue;

      //      Texture t = m.GetBitmapTexture();
      //      if (t == null || t.FileReference == null) continue;

      meshes.Add(mesh[0]);
      guids.Add(o.Id.ToString());
      materials.Add(m.Id);
    }

    Meshes = meshes;
    Materials = materials;
    Guids = guids;
# ---------- end c__gettextures ----------
mesh = Mesh(c__gettextures.Meshes)

c__majoritylabels = CSharpScript(PreLabeledMeshFaces=c__combineframes.CombinedLabeledFaces)  # -> out, LabeledMeshFaces; inputs PreLabeledMeshFaces: list of String; disabled
# ---------- c__majoritylabels: C# ----------
// Grasshopper Script Instance
#region Usings
using System;
using System.Linq;
using System.Collections;
using System.Collections.Generic;
using System.Drawing;

using Rhino;
using Rhino.Geometry;

using Grasshopper;
using Grasshopper.Kernel;
using Grasshopper.Kernel.Data;
using Grasshopper.Kernel.Types;
#endregion

public class Script_Instance : GH_ScriptInstance
{
    #region Notes
    /* 
      Members:
        RhinoDoc RhinoDocument
        GH_Document GrasshopperDocument
        IGH_Component Component
        int Iteration

      Methods (Virtual & overridable):
        Print(string text)
        Print(string format, params object[] args)
        Reflect(object obj)
        Reflect(object obj, string method_name)
    */
    #endregion

    private void RunScript(
	List<string> PreLabeledMeshFaces,
	ref object LabeledMeshFaces)
    {
        Dictionary<string, int> labelCts = new Dictionary<string, int>();
        foreach(string label in PreLabeledMeshFaces)
        {
            if (!labelCts.ContainsKey(label))
            {
                labelCts.Add(label, 0);
            }
            labelCts[label] += 1;
        }
        string topLabel = "";
        int topCt = 0;
        foreach(var kvp in labelCts)
        {
            if (kvp.Value > topCt)
            {
                topLabel = kvp.Key;
                topCt = kvp.Value;
            }
        }
        
        LabeledMeshFaces = topLabel;

        
    }
}
# ---------- end c__majoritylabels ----------
c__meshdividebylabel = CSharpScript(Meshes=mesh, LabeledMeshFaces=c__combineframesandvote.CombinedLabeledFaces)  # -> out, MeshLabels, MeshesByLabel; inputs Meshes: list of Mesh, LabeledMeshFaces: tree of String; disabled
# ---------- c__meshdividebylabel: C# ----------
// Grasshopper Script Instance
#region Usings
using System;
using System.Linq;
using System.Collections;
using System.Collections.Generic;
using System.Drawing;

using Rhino;
using Rhino.Geometry;

using Grasshopper;
using Grasshopper.Kernel;
using Grasshopper.Kernel.Data;
using Grasshopper.Kernel.Types;
#endregion

public class Script_Instance : GH_ScriptInstance
{
    #region Notes
    /* 
      Members:
        RhinoDoc RhinoDocument
        GH_Document GrasshopperDocument
        IGH_Component Component
        int Iteration

      Methods (Virtual & overridable):
        Print(string text)
        Print(string format, params object[] args)
        Reflect(object obj)
        Reflect(object obj, string method_name)
    */
    #endregion

    private void RunScript(
	List<Mesh> Meshes,
	DataTree<string> LabeledMeshFaces,
	ref object MeshLabels,
	ref object MeshesByLabel)
    {
        var labelsWithMeshIdxId = new Dictionary<string, Dictionary<int, List<int>>>();
        foreach(var path in LabeledMeshFaces.Paths)
        {
            if (path.Indices.Length != 2)
            {
                Print("Unexpected path format");
                return;
            }
            int meshIdx = path.Indices[0];
            int faceIdx = path.Indices[1];
            if (meshIdx == -1 || faceIdx == -1) continue;
            var branch = LabeledMeshFaces.Branch(path);
            if (branch.Count != 1)
            {
                Print("Unexpected branch length");
                return;
            }
            string label = branch[0];
            //Print($"{meshIdx},{faceIdx},{label}");
            if (!labelsWithMeshIdxId.ContainsKey(label))
            {
                labelsWithMeshIdxId.Add(label, new Dictionary<int, List<int>>());
            }
            if (!labelsWithMeshIdxId[label].ContainsKey(meshIdx))
            {
                labelsWithMeshIdxId[label].Add(meshIdx, new List<int>());
            }
            labelsWithMeshIdxId[label][meshIdx].Add(faceIdx);
        }

        List<string> finalLabels = new List<string>();
        List<Mesh> finalMeshes = new List<Mesh>();
        foreach(var kvp1 in labelsWithMeshIdxId)
        {
            Mesh finalMesh = new Mesh();
            foreach(var kvp2 in kvp1.Value)
            {
                finalMesh.Append(GetSubMesh(Meshes[kvp2.Key], kvp2.Value));
            }
            finalLabels.Add(kvp1.Key);
            finalMeshes.Add(finalMesh);
        }

        MeshLabels = finalLabels;
        MeshesByLabel = finalMeshes;


    }

    private Mesh GetSubMesh(Mesh m, List<int> faceIds)
    {
        var m2 = m.DuplicateMesh();
        return m2.Faces.ExtractFaces(faceIds);
    }
}
# ---------- end c__meshdividebylabel ----------
number_slider_4 = Slider(4, range=0..45)  # disabled
item_13 = ListItem(List=c__meshdividebylabel.MeshesByLabel, Index=number_slider_4, Wrap=True)  # disabled
item_14 = ListItem(List=c__meshdividebylabel.MeshLabels, Index=number_slider_4, Wrap=True)  # disabled
c__labelcolors = CSharpScript(LabelList=c__meshdividebylabel.MeshLabels)  # -> out, Colors; inputs LabelList: list of String; disabled
# ---------- c__labelcolors: C# ----------
// Grasshopper Script Instance
#region Usings
using System;
using System.Linq;
using System.Collections;
using System.Collections.Generic;
using System.Drawing;

using Rhino;
using Rhino.Geometry;

using Grasshopper;
using Grasshopper.Kernel;
using Grasshopper.Kernel.Data;
using Grasshopper.Kernel.Types;
#endregion

public class Script_Instance : GH_ScriptInstance
{
    #region Notes
    /* 
      Members:
        RhinoDoc RhinoDocument
        GH_Document GrasshopperDocument
        IGH_Component Component
        int Iteration

      Methods (Virtual & overridable):
        Print(string text)
        Print(string format, params object[] args)
        Reflect(object obj)
        Reflect(object obj, string method_name)
    */
    #endregion

    private void RunScript(List<string> LabelList, ref object Colors)
    {
        Random r = new Random();
        List<Color> colors = new List<Color>();
        foreach(var label in LabelList)
        {
            colors.Add(Color.FromArgb(255, (int)r.NextInt64(0, 255), (int)r.NextInt64(0, 255), (int)r.NextInt64(0, 255)));
        }
        Colors = colors;
    }
}
# ---------- end c__labelcolors ----------
panel_5 = Panel(item_14)  # disabled
preview_2 = CustomPreview(Geometry=c__meshdividebylabel.MeshesByLabel, Material=c__labelcolors.Colors)  # disabled

c__meshdividebylabel2 = CSharpScript(Meshes=mesh, LabeledMeshFaces=c__combineframes.CombinedLabeledFaces)  # -> out, MeshLabels, MeshesByLabel; inputs Meshes: list of Mesh, LabeledMeshFaces: tree of String; disabled
# ---------- c__meshdividebylabel2: C# ----------
// Grasshopper Script Instance
#region Usings
using System;
using System.Linq;
using System.Collections;
using System.Collections.Generic;
using System.Drawing;

using Rhino;
using Rhino.Geometry;

using Grasshopper;
using Grasshopper.Kernel;
using Grasshopper.Kernel.Data;
using Grasshopper.Kernel.Types;
#endregion

public class Script_Instance : GH_ScriptInstance
{
    #region Notes
    /* 
      Members:
        RhinoDoc RhinoDocument
        GH_Document GrasshopperDocument
        IGH_Component Component
        int Iteration

      Methods (Virtual & overridable):
        Print(string text)
        Print(string format, params object[] args)
        Reflect(object obj)
        Reflect(object obj, string method_name)
    */
    #endregion

    private void RunScript(
	List<Mesh> Meshes,
	DataTree<string> LabeledMeshFaces,
	ref object MeshLabels,
	ref object MeshesByLabel)
    {
        var labelsWithMeshIdxId = new Dictionary<string, Dictionary<int, List<int>>>();
        foreach(var path in LabeledMeshFaces.Paths)
        {
            if (path.Indices.Length != 2)
            {
                Print("Unexpected path format");
                return;
            }
            int meshIdx = path.Indices[0];
            int faceIdx = path.Indices[1];
            if (meshIdx == -1 || faceIdx == -1) continue;
            var branch = LabeledMeshFaces.Branch(path);
            List<string> labels = branch;
            foreach(string label in labels)
            {
                if (!labelsWithMeshIdxId.ContainsKey(label))
                {
                    labelsWithMeshIdxId.Add(label, new Dictionary<int, List<int>>());
                }
                if (!labelsWithMeshIdxId[label].ContainsKey(meshIdx))
                {
                    labelsWithMeshIdxId[label].Add(meshIdx, new List<int>());
                }
                if (!labelsWithMeshIdxId[label][meshIdx].Contains(faceIdx))
                {
                    labelsWithMeshIdxId[label][meshIdx].Add(faceIdx);
                }
            }
        }

        List<string> finalLabels = new List<string>();
        List<Mesh> finalMeshes = new List<Mesh>();
        foreach(var kvp1 in labelsWithMeshIdxId)
        {
            Mesh finalMesh = new Mesh();
            foreach(var kvp2 in kvp1.Value)
            {
                finalMesh.Append(GetSubMesh(Meshes[kvp2.Key], kvp2.Value));
            }
            finalLabels.Add(kvp1.Key);
            finalMeshes.Add(finalMesh);
        }

        MeshLabels = finalLabels;
        MeshesByLabel = finalMeshes;


    }

    private Mesh GetSubMesh(Mesh m, List<int> faceIds)
    {
        Mesh m2 = m.DuplicateMesh();
        return m2.Faces.ExtractFaces(faceIds);
    }
}
# ---------- end c__meshdividebylabel2 ----------
number_slider_5 = Slider(0, range=0..14)  # disabled
item_15 = ListItem(List=c__meshdividebylabel2.MeshLabels, Index=number_slider_5, Wrap=True)  # disabled
item_16 = ListItem(List=c__meshdividebylabel2.MeshesByLabel, Index=number_slider_5, Wrap=True)  # disabled
panel_6 = Panel(item_15)
c__labelcolors_2 = CSharpScript(LabelList=item_15)  # -> out, Colors; inputs LabelList: list of String; disabled; same code as c__labelcolors
preview_3 = CustomPreview(Geometry=item_16, Material=c__labelcolors_2.Colors)  # disabled

c__meshdividebylabel2_2 = CSharpScript(Meshes=mesh, LabeledMeshFaces=c__majoritylabels.LabeledMeshFaces)  # -> out, FinalMeshes, MeshLabels, SourceMeshIndices; inputs Meshes: list of Mesh, LabeledMeshFaces: tree of String, UniqueClasses: list of String; disabled
# ---------- c__meshdividebylabel2_2: C# ----------
// Grasshopper Script Instance
#region Usings
using System;
using System.Linq;
using System.Collections;
using System.Collections.Generic;
using System.Drawing;

using Rhino;
using Rhino.Geometry;

using Grasshopper;
using Grasshopper.Kernel;
using Grasshopper.Kernel.Data;
using Grasshopper.Kernel.Types;
#endregion

public class Script_Instance : GH_ScriptInstance
{
    #region Notes
    /* 
      Members:
        RhinoDoc RhinoDocument
        GH_Document GrasshopperDocument
        IGH_Component Component
        int Iteration

      Methods (Virtual & overridable):
        Print(string text)
        Print(string format, params object[] args)
        Reflect(object obj)
        Reflect(object obj, string method_name)
    */
    #endregion

    private void RunScript(
	List<Mesh> Meshes,
	DataTree<string> LabeledMeshFaces,
	List<string> UniqueClasses,
	ref object FinalMeshes,
	ref object MeshLabels,
	ref object SourceMeshIndices)
    {
        List<int>[,] faceIndicesPerMeshPerMaterial = new List<int>[Meshes.Count, UniqueClasses.Count];
        foreach(var path in LabeledMeshFaces.Paths)
        {
            if (path.Indices.Length != 2)
            {
                Print("Unexpected path format");
                return;
            }
            int meshIdx = path.Indices[0];
            int faceIdx = path.Indices[1];
            if (meshIdx == -1 || faceIdx == -1) continue;
            var branch = LabeledMeshFaces.Branch(path);
            if (branch.Count != 1)
            {
                Print("Unexpected branch length");
                return;
            }
            string label = branch[0];
            int labelIdx = UniqueClasses.IndexOf(label);
            if (faceIndicesPerMeshPerMaterial[meshIdx, labelIdx] == null) faceIndicesPerMeshPerMaterial[meshIdx, labelIdx] = new List<int>();
            if (!faceIndicesPerMeshPerMaterial[meshIdx, labelIdx].Contains(faceIdx)) faceIndicesPerMeshPerMaterial[meshIdx, labelIdx].Add(faceIdx);
        }
        List<Mesh> finalMeshes = new List<Mesh>();
        List<string> meshLabels = new List<string>();
        List<int> sourceMeshIndices = new List<int>();
        for (int m = 0; m < Meshes.Count; m++)
        {
            for (int c = 0; c < UniqueClasses.Count; c++)
            {
                Mesh tmp = Meshes[m].DuplicateMesh();
                if (faceIndicesPerMeshPerMaterial[m, c] == null) continue;
                Mesh extracted = tmp.Faces.ExtractFaces(faceIndicesPerMeshPerMaterial[m, c]);
                finalMeshes.Add(extracted);
                meshLabels.Add(UniqueClasses[c]);
                sourceMeshIndices.Add(m);
            }
        }

        FinalMeshes = finalMeshes;
        MeshLabels = meshLabels;
        SourceMeshIndices = sourceMeshIndices;
    }

    private Mesh GetSubMesh(Mesh m, List<int> faceIds)
    {
        var m2 = m.DuplicateMesh();
        return m2.Faces.ExtractFaces(faceIds);
    }
}
# ---------- end c__meshdividebylabel2_2 ----------
c__settextures = CSharpScript(
    Meshes=c__meshdividebylabel2_2.FinalMeshes,
    MeshLabels=c__meshdividebylabel2_2.MeshLabels,
    SourceMeshIndices=c__meshdividebylabel2_2.SourceMeshIndices,
    MaterialIds=c__gettextures.Materials,
    OutLayerName="ClassifiedRenderMeshes")  # -> out, a; inputs Meshes: list of Mesh, MeshLabels: list of String, SourceMeshIndices: list of Int32, MaterialIds: list of String, OutLayerName: String; disabled
# ---------- c__settextures: C# ----------
// Grasshopper Script Instance
#region Usings
using System;
using System.Linq;
using System.Collections;
using System.Collections.Generic;
using System.Drawing;

using Rhino;
using Rhino.DocObjects;
using Rhino.Geometry;

using Grasshopper;
using Grasshopper.Kernel;
using Grasshopper.Kernel.Data;
using Grasshopper.Kernel.Types;
#endregion

public class Script_Instance : GH_ScriptInstance
{
    #region Notes
    /* 
      Members:
        RhinoDoc RhinoDocument
        GH_Document GrasshopperDocument
        IGH_Component Component
        int Iteration

      Methods (Virtual & overridable):
        Print(string text)
        Print(string format, params object[] args)
        Reflect(object obj)
        Reflect(object obj, string method_name)
    */
    #endregion

    private void RunScript(
	List<Mesh> Meshes,
	List<string> MeshLabels,
	List<int> SourceMeshIndices,
	List<string> MaterialIds,
	string OutLayerName,
	ref object a)
    {
        if (Meshes.Count != SourceMeshIndices.Count || Meshes.Count != MeshLabels.Count) return;
        Layer layer = RhinoDoc.ActiveDoc.Layers.FindName(OutLayerName);
        int layerIdx;
        if (layer == null)
        {
            layerIdx = RhinoDoc.ActiveDoc.Layers.Add(OutLayerName, System.Drawing.Color.Black);
            layer = RhinoDoc.ActiveDoc.Layers.FindName(OutLayerName);
        }
        else layerIdx = layer.Index;
        for (int i = 0; i < Meshes.Count; i++)
        {
            Guid matId = new Guid(MaterialIds[SourceMeshIndices[i]]);
            int bakeLayerIdx = -1;
            var children = layer.GetChildren();
            string label = MeshLabels[i];
            if (children != null && children.Length > 0)
            {
                foreach(var c in children)
                {
                    if (c.Name == label)
                    {
                        bakeLayerIdx = c.Index;
                        break;
                    }
                }
            }
            if (bakeLayerIdx == -1)
            {
                Layer bakeLayer = new Layer();
                bakeLayer.ParentLayerId = layer.Id;
                bakeLayer.Name = label;
                bakeLayerIdx = RhinoDoc.ActiveDoc.Layers.Add(bakeLayer);
            }


            ObjectAttributes att = new ObjectAttributes();
            att.LayerIndex = bakeLayerIdx;

            Guid id = RhinoDoc.ActiveDoc.Objects.AddMesh(Meshes[i], att);
            RhinoObject addedMesh = RhinoDoc.ActiveDoc.Objects.FindId(id);
            if (addedMesh == null)
            {
            Print("could not find added mesh");
            return;
            }

            addedMesh.RenderMaterial = RhinoDoc.ActiveDoc.Materials.FindId(matId).RenderMaterial;
            addedMesh.CommitChanges();
        }
    }
}
# ---------- end c__settextures ----------

panel_7 = Panel(c__meshdividebylabel.MeshLabels)
c__combineframesandvote_2 = CSharpScript(
    Meshes=mesh,
    LabeledMeshFaces=c__jsonin.LabeledMeshIdsFaceIdsWithCt,
    FrameIdx=referenceframe,
    Label=item_12,
    Reset=button)  # -> out, CombinedLabeledFaces, CombinedLabeledFacesScores, FaceCenters; inputs Meshes: list of Mesh, LabeledMeshFaces: tree of Int32, FrameIdx: Int32, Label: String, Reset: Boolean
# ---------- c__combineframesandvote_2: C# ----------
// Grasshopper Script Instance
#region Usings
using System;
using System.Linq;
using System.Collections;
using System.Collections.Generic;
using System.Drawing;

using Rhino;
using Rhino.Geometry;

using Grasshopper;
using Grasshopper.Kernel;
using Grasshopper.Kernel.Data;
using Grasshopper.Kernel.Types;
#endregion

public class Script_Instance : GH_ScriptInstance
{
    #region Notes
    /* 
      Members:
        RhinoDoc RhinoDocument
        GH_Document GrasshopperDocument
        IGH_Component Component
        int Iteration

      Methods (Virtual & overridable):
        Print(string text)
        Print(string format, params object[] args)
        Reflect(object obj)
        Reflect(object obj, string method_name)
    */
    #endregion

    Dictionary<int, Dictionary<int, Dictionary<string, int>>> _collectedLabels = new Dictionary<int, Dictionary<int, Dictionary<string, int>>>(); //{meshIdx, {faceIdx, {label, count}}}
    bool _resetting = false;

    private void RunScript(
		List<Mesh> Meshes,
		DataTree<int> LabeledMeshFaces,
		int FrameIdx,
		string Label,
		bool Reset,
		ref object CombinedLabeledFaces,
		ref object CombinedLabeledFacesScores,
		ref object FaceCenters)
    {
        if (Reset) 
        {
            _collectedLabels.Clear();
            _resetting = true;
            return;
        }
        else if (_resetting)
        {
            _resetting = false;
            return;
        }
        var collectedLabels = new Dictionary<int, Dictionary<int, Dictionary<string, int>>>(); //{meshIdx, {faceIdx, {label, count}}}
        bool visited = false;
        Dictionary<int, List<int>> faces = new Dictionary<int, List<int>>();
        foreach(var path in LabeledMeshFaces.Paths)
        {
            int[] indices = path.Indices;
            if (indices.Length != 3)
            {
                Print("Unexpected path length");
                return;
            }
            if (indices[0] != FrameIdx && visited) break;
            if (indices[0] != FrameIdx) continue;
            visited = true;
            int meshIdx = indices[1];
            int faceIdx = indices[2];
            if (meshIdx == -1 || faceIdx == -1) continue;
            string label = Label;
            if (!faces.ContainsKey(meshIdx)) faces.Add(meshIdx, new List<int>());
            if (!faces[meshIdx].Contains(faceIdx)) faces[meshIdx].Add(faceIdx);
            if (!_collectedLabels.ContainsKey(meshIdx)) _collectedLabels.Add(meshIdx, new Dictionary<int, Dictionary<string, int>>());
            if (!_collectedLabels[meshIdx].ContainsKey(faceIdx)) _collectedLabels[meshIdx].Add(faceIdx, new Dictionary<string, int>());
            if (!_collectedLabels[meshIdx][faceIdx].ContainsKey(label)) _collectedLabels[meshIdx][faceIdx].Add(label, 0);
            _collectedLabels[meshIdx][faceIdx][label] += LabeledMeshFaces.Branch(path)[0];
            // GH_Path addPath = new GH_Path(new int[] {meshIdx, faceIdx});
            // List<string> labels = combinedLabeledFaces.EnsurePath(addPath);
            // for (int i = 0; i < LabeledMeshFaces.Branch(path)[0]; i++)
            // {
            //     labels.Add(Labels[frameIdx]);
            // }
        }

        DataTree<string> combinedLabeledFaces = new DataTree<string>();
        DataTree<int> combinedLabeledFacesScores = new DataTree<int>();
        foreach(int meshIdx in _collectedLabels.Keys)
        {
            foreach(int faceIdx in _collectedLabels[meshIdx].Keys)
            {
                var dictList = _collectedLabels[meshIdx][faceIdx].ToList();
                if (dictList.Count == 0) continue;
                dictList = dictList.OrderByDescending(kvp => kvp.Value).ToList();
                GH_Path path = new GH_Path(meshIdx, faceIdx);
                List<string> label = combinedLabeledFaces.EnsurePath(path);
                label.Add(dictList[0].Key);
                List<int> score = combinedLabeledFacesScores.EnsurePath(path);
                score.Add(dictList[0].Value);
            }
        }
        
        CombinedLabeledFaces = combinedLabeledFaces;
        CombinedLabeledFacesScores = combinedLabeledFacesScores;
        FaceCenters = faces.Keys.SelectMany(m => faces[m].Select(f => Meshes[m].Faces.GetFaceCenter(f)).ToList()).ToList();
    }
}
# ---------- end c__combineframesandvote_2 ----------
panel_8 = Panel(c__combineframesandvote_2.CombinedLabeledFaces)
c__meshdividebylabel_2 = CSharpScript(Meshes=mesh, LabeledMeshFaces=c__combineframesandvote_2.CombinedLabeledFaces)  # -> out, MeshLabels, MeshesByLabel; inputs Meshes: list of Mesh, LabeledMeshFaces: tree of String
# ---------- c__meshdividebylabel_2: C# ----------
// Grasshopper Script Instance
#region Usings
using System;
using System.Linq;
using System.Collections;
using System.Collections.Generic;
using System.Drawing;

using Rhino;
using Rhino.Geometry;

using Grasshopper;
using Grasshopper.Kernel;
using Grasshopper.Kernel.Data;
using Grasshopper.Kernel.Types;
#endregion

public class Script_Instance : GH_ScriptInstance
{
    #region Notes
    /* 
      Members:
        RhinoDoc RhinoDocument
        GH_Document GrasshopperDocument
        IGH_Component Component
        int Iteration

      Methods (Virtual & overridable):
        Print(string text)
        Print(string format, params object[] args)
        Reflect(object obj)
        Reflect(object obj, string method_name)
    */
    #endregion

    private void RunScript(
		List<Mesh> Meshes,
		DataTree<string> LabeledMeshFaces,
		ref object MeshLabels,
		ref object MeshesByLabel)
    {
        var labelsWithMeshIdxId = new Dictionary<string, Dictionary<int, List<int>>>();
        foreach(var path in LabeledMeshFaces.Paths)
        {
            if (path.Indices.Length != 2)
            {
                Print("Unexpected path format");
                return;
            }
            int meshIdx = path.Indices[0];
            int faceIdx = path.Indices[1];
            if (meshIdx == -1 || faceIdx == -1) continue;
            var branch = LabeledMeshFaces.Branch(path);
            if (branch.Count != 1)
            {
                Print("Unexpected branch length");
                return;
            }
            string label = branch[0];
            //Print($"{meshIdx},{faceIdx},{label}");
            if (!labelsWithMeshIdxId.ContainsKey(label))
            {
                labelsWithMeshIdxId.Add(label, new Dictionary<int, List<int>>());
            }
            if (!labelsWithMeshIdxId[label].ContainsKey(meshIdx))
            {
                labelsWithMeshIdxId[label].Add(meshIdx, new List<int>());
            }
            labelsWithMeshIdxId[label][meshIdx].Add(faceIdx);
        }

        List<string> finalLabels = new List<string>();
        List<Mesh> finalMeshes = new List<Mesh>();
        foreach(var kvp1 in labelsWithMeshIdxId)
        {
            Mesh finalMesh = new Mesh();
            foreach(var kvp2 in kvp1.Value)
            {
                finalMesh.Append(GetSubMesh(Meshes[kvp2.Key], kvp2.Value));
            }
            finalLabels.Add(kvp1.Key);
            finalMeshes.Add(finalMesh);
        }

        MeshLabels = finalLabels;
        MeshesByLabel = finalMeshes;


    }

    private Mesh GetSubMesh(Mesh m, List<int> faceIds)
    {
        var m2 = m.DuplicateMesh();
        return m2.Faces.ExtractFaces(faceIds);
    }
}
# ---------- end c__meshdividebylabel_2 ----------
item_17 = ListItem(List=c__meshdividebylabel_2.MeshLabels, Index=number_slider_2, Wrap=True)
item_18 = ListItem(List=c__meshdividebylabel_2.MeshesByLabel, Index=number_slider_2, Wrap=True)
c__drawcamlines = CSharpScript(StartPt=item_11, EndPts=c__combineframesandvote_2.FaceCenters)  # -> out; inputs StartPt: Point3d, EndPts: list of Point3d
# ---------- c__drawcamlines: C# ----------
// Grasshopper Script Instance
#region Usings
using System;
using System.Linq;
using System.Collections;
using System.Collections.Generic;
using System.Drawing;

using Rhino;
using Rhino.Geometry;

using Grasshopper;
using Grasshopper.Kernel;
using Grasshopper.Kernel.Data;
using Grasshopper.Kernel.Types;
#endregion

public class Script_Instance : GH_ScriptInstance
{
    #region Notes
    /* 
      Members:
        RhinoDoc RhinoDocument
        GH_Document GrasshopperDocument
        IGH_Component Component
        int Iteration

      Methods (Virtual & overridable):
        Print(string text)
        Print(string format, params object[] args)
        Reflect(object obj)
        Reflect(object obj, string method_name)
    */
    #endregion

    private void RunScript(Point3d StartPt, List<Point3d> EndPts)
    {
        _lines.Clear();
        foreach(Point3d e in EndPts)
        {
            _lines.Add(new Line(StartPt, e));
        }
    }

    private List<Line> _lines = new List<Line>();

    public override BoundingBox ClippingBox => BoundingBox.Empty;

    public override void DrawViewportMeshes(IGH_PreviewArgs args)
    {
    }

    public override void DrawViewportWires(IGH_PreviewArgs args)
    {
        args.Display.DrawLines(_lines, Color.White);
    }

    
}
# ---------- end c__drawcamlines ----------
c__collectareas = CSharpScript(
    MeshLabels=c__meshdividebylabel_2.MeshLabels,
    MeshesByLabel=c__meshdividebylabel_2.MeshesByLabel,
    AllLabels=panel,
    ResetCsv=button)  # -> out, AreasCsv; inputs MeshLabels: list of String, MeshesByLabel: list of Mesh, AllLabels: list of String, ResetCsv: Boolean
# ---------- c__collectareas: C# ----------
// Grasshopper Script Instance
#region Usings
using System;
using System.Linq;
using System.Collections;
using System.Collections.Generic;
using System.Drawing;

using Rhino;
using Rhino.Geometry;

using Grasshopper;
using Grasshopper.Kernel;
using Grasshopper.Kernel.Data;
using Grasshopper.Kernel.Types;
#endregion

public class Script_Instance : GH_ScriptInstance
{
    #region Notes
    /* 
      Members:
        RhinoDoc RhinoDocument
        GH_Document GrasshopperDocument
        IGH_Component Component
        int Iteration

      Methods (Virtual & overridable):
        Print(string text)
        Print(string format, params object[] args)
        Reflect(object obj)
        Reflect(object obj, string method_name)
    */
    #endregion

    private void RunScript(
	List<string> MeshLabels,
	List<Mesh> MeshesByLabel,
	List<string> AllLabels,
	bool ResetCsv,
	ref object AreasCsv)
    {
        if (_resetting)
        {
            _resetting = false;
            return;
        }
        else if (ResetCsv)
        {
            _resetting = true;
            _csv = "";
            _ct = 0;
            return;
        }
        
        if (_csv == "")
        {
            for (int i = 0; i < AllLabels.Count; i++)
            {
                _csv += AllLabels[i];
                if (i < AllLabels.Count - 1)
                {
                    _csv += ",";
                }
            }
            _csv += "\n";
        }
        if (MeshLabels.Count != MeshesByLabel.Count)
        {
            Print("List lengths do not match");
            return;
        }
        string[] areas = new string[AllLabels.Count];
        for (int i = 0; i < MeshLabels.Count; i++)
        {
            string label = MeshLabels[i];
            Mesh mesh = MeshesByLabel[i];
            double area = AreaMassProperties.Compute(mesh).Area;
            int idx = AllLabels.IndexOf(label);
            if (idx == -1)
            {
                Print("Label not found");
                return;
            }
            if (areas[idx] != null)
            {
                Print("Area entry is not empty");
                return;
            }
            areas[idx] = area.ToString("0.######");//depending on scale of model, this could be quite small. models are not in any defined scale 

        }

        for(int i = 0; i < areas.Length; i++)
        {
            _csv += areas[i] ?? "0";
            _csv += ",";
        }

        _csv += $"{_ct}\n";
        

        AreasCsv = _csv;
        _ct++;
    }

    private int _ct = 0;
    private string _csv = "";
    private bool _resetting = false;
}
# ---------- end c__collectareas ----------
c__labelcolors_3 = CSharpScript(LabelList=c__meshdividebylabel_2.MeshLabels, AllLabels=panel, AllColors=merge)  # -> out, Colors; inputs LabelList: list of String, AllLabels: list of String, AllColors: list of Color
# ---------- c__labelcolors_3: C# ----------
// Grasshopper Script Instance
#region Usings
using System;
using System.Linq;
using System.Collections;
using System.Collections.Generic;
using System.Drawing;

using Rhino;
using Rhino.Geometry;

using Grasshopper;
using Grasshopper.Kernel;
using Grasshopper.Kernel.Data;
using Grasshopper.Kernel.Types;
#endregion

public class Script_Instance : GH_ScriptInstance
{
    #region Notes
    /* 
      Members:
        RhinoDoc RhinoDocument
        GH_Document GrasshopperDocument
        IGH_Component Component
        int Iteration

      Methods (Virtual & overridable):
        Print(string text)
        Print(string format, params object[] args)
        Reflect(object obj)
        Reflect(object obj, string method_name)
    */
    #endregion

    private void RunScript(
	List<string> LabelList,
	List<string> AllLabels,
	List<Color> AllColors,
	ref object Colors)
    {
        List<Color> colors = new List<Color>();
        foreach(var label in LabelList)
        {
            int idx = AllLabels.IndexOf(label);
            colors.Add(AllColors[idx]);
        }
        Colors = colors;
    }
}
# ---------- end c__labelcolors_3 ----------
preview_4 = CustomPreview(Geometry=c__meshdividebylabel_2.MeshesByLabel, Material=c__labelcolors_3.Colors)
c__writetexttofile_7 = CSharpScript(WriteDir=path_3, FileName="AreasCollected", Txt=c__collectareas.AreasCsv)  # -> out; inputs WriteDir: String, FileName: String, Txt: list of String; same code as c__writetexttofile
panel_9 = Panel(c__collectareas.AreasCsv)
