# Grasshopper definition results_to_model.gh (Grasshopper 1.0.8)

path = FilePath("G:\My Drive\GSD_AI\02_Models\Matterport\Matterport_Scans_Imgs\scans\17DRP5sb8fy\undistorted_camera_parameters\17DRP5sb8fy\undistorted_camera_parameters\17DRP5sb8fy.conf")
panel = Panel(path)
c__cameraposes = CSharpScript(TransformDataPath=path)  # -> out, Transforms, DepthImgPaths, RgbImgPaths, SegmentImgPaths, FocalLengthsXPx, FocalLengthsYPx, OpticalCentersXPx, OpticalCentersYPx; inputs TransformDataPath: String
# ---------- c__cameraposes: C# ----------
// Grasshopper Script Instance
#region Usings
using System;
using System.Linq;
using System.Collections;
using System.Collections.Generic;
using System.Drawing;

using Rhino;
using Rhino.Geometry;

using Grasshopper;
using Grasshopper.Kernel;
using Grasshopper.Kernel.Data;
using Grasshopper.Kernel.Types;

using System.IO;
using System.Linq;

#endregion

public class Script_Instance : GH_ScriptInstance
{
    #region Notes
    /* 
      Members:
        RhinoDoc RhinoDocument
        GH_Document GrasshopperDocument
        IGH_Component Component
        int Iteration

      Methods (Virtual & overridable):
        Print(string text)
        Print(string format, params object[] args)
        Reflect(object obj)
        Reflect(object obj, string method_name)
    */
    #endregion

    private void RunScript(
		string TransformDataPath,
		ref object Transforms,
		ref object DepthImgPaths,
		ref object RgbImgPaths,
		ref object SegmentImgPaths,
		ref object FocalLengthsXPx,
		ref object FocalLengthsYPx,
		ref object OpticalCentersXPx,
		ref object OpticalCentersYPx)
    {
        
        string colorDir = String.Empty;
        string depthDir = String.Empty;
        List<Transform> xForms = new List<Transform>();
        List<string> rgbImgPaths = new List<string>();
        List<string> depthImgPaths = new List<string>();
        List<string> segmentImgPaths = new List<string>();
        List<double> xFocalLengths = new List<double>();
        List<double> yFocalLengths = new List<double>();
        List<double> xOpticalCenters = new List<double>();
        List<double> yOpticalCenters = new List<double>();

        using (StreamReader sr = File.OpenText(TransformDataPath))
        {
            //see https://github.com/niessner/Matterport/blob/master/data_organization.md for documentation on values.
            string s = String.Empty;
            double focalLengthXPx = 0;
            double focalLengthYPx = 0;
            double opticalCenterXPx = 0;
            double opticalCenterYPx = 0;
            while ((s = sr.ReadLine()) != null)
            {
                string[] sections = s.Split(' ');
                if (sections == null || sections.Length == 0) continue;
                List<string> cleanedSections = new List<string>();
                foreach(string sec in sections)
                {
                    if (sec != "") cleanedSections.Add(sec);
                }
                if (cleanedSections.Count == 0) continue;
                sections = cleanedSections.ToArray();
                if (colorDir == String.Empty && sections[0] == "color_directory" && sections.Length > 1)
                {
                    colorDir = RebuildPath(sections);
                    Print(colorDir);
                    continue;
                }
                
                if (depthDir == String.Empty && sections[0] == "depth_directory" && sections.Length > 1)
                {
                    depthDir = RebuildPath(sections);
                    Print(depthDir);
                    continue;
                }

                if (sections[0] == "intrinsics_matrix" && sections.Length == 10)
                {
                    if (!double.TryParse(sections[1], out focalLengthXPx) ||
                        !double.TryParse(sections[3], out opticalCenterXPx) ||
                        !double.TryParse(sections[5], out focalLengthYPx) ||
                        !double.TryParse(sections[6], out opticalCenterYPx))
                    {
                        this.Component.AddRuntimeMessage(GH_RuntimeMessageLevel.Error, "Failed to parse camera intrinsics");
                        return;
                    }
                    continue;
                }

                if (sections[0] != "scan") continue;
                
                if (sections.Length != 19)
                {
                    this.Component.AddRuntimeMessage(GH_RuntimeMessageLevel.Error, "Scan section has unexpected line length");
                    return;
                }

                string rgbImgPath = colorDir + "/" + sections[2];
                string segmentImgPath = colorDir + "/Segment/" + sections[2] + "_masked.png";
                string depthImgPath = depthDir + "/" + sections[1];
                rgbImgPaths.Add(rgbImgPath);
                depthImgPaths.Add(depthImgPath);
                segmentImgPaths.Add(segmentImgPath);
                if (!File.Exists(rgbImgPath) || !File.Exists(depthImgPath) /*|| !File.Exists(segmentImgPath)*/)
                {
                    this.Component.AddRuntimeMessage(GH_RuntimeMessageLevel.Error, "Could not locate image file");
                    return;
                }

                Transform t = Transform.Identity;
                for(int r = 0; r < 4; r++) for(int c = 0; c < 4; c++)
                {
                    int i = 3 + r * 4 + c;
                    double d = 0;
                    if (!double.TryParse(sections[i], out d))
                    {
                    this.Component.AddRuntimeMessage(GH_RuntimeMessageLevel.Error, "Could not parse transform data");
                    return;
                    }
                    t[r, c] = d;
                }
                xForms.Add(t);
                xFocalLengths.Add(focalLengthXPx);
                yFocalLengths.Add(focalLengthYPx);
                xOpticalCenters.Add(opticalCenterXPx);
                yOpticalCenters.Add(opticalCenterYPx);
                //build camera geometry
                //transform camera geometry





            }
        }

        Transforms = xForms;
        RgbImgPaths = rgbImgPaths;
        DepthImgPaths = depthImgPaths;
        SegmentImgPaths = segmentImgPaths;
        FocalLengthsXPx = xFocalLengths;
        FocalLengthsYPx = yFocalLengths;
        OpticalCentersXPx = xOpticalCenters;
        OpticalCentersYPx = yOpticalCenters;
    }


    //Rebuilds path info in case spaces were part of original path, since the file is space delimeted
    private string RebuildPath(string[] splitPath)
    {
        string path = splitPath[1];
        for(int i = 2; i < splitPath.Length; i++)
        {
            path += " " + splitPath[i];
        }

        return path;
    }
}
# ---------- end c__cameraposes ----------
imgindices = Integer(Slider(0, range=0..100))
item = ListItem(List=c__cameraposes.FocalLengthsXPx, Index=imgindices, Wrap=True)
item_2 = ListItem(List=c__cameraposes.DepthImgPaths, Index=imgindices, Wrap=True)
item_3 = ListItem(List=c__cameraposes.FocalLengthsYPx, Index=imgindices, Wrap=True)
item_4 = ListItem(List=c__cameraposes.RgbImgPaths, Index=imgindices, Wrap=True)
item_5 = ListItem(List=c__cameraposes.OpticalCentersYPx, Index=imgindices, Wrap=True)
item_6 = ListItem(List=c__cameraposes.OpticalCentersXPx, Index=imgindices, Wrap=True)
item_7 = ListItem(List=c__cameraposes.SegmentImgPaths, Index=imgindices, Wrap=True)
item_8 = ListItem(List=c__cameraposes.Transforms, Index=imgindices, Wrap=True)
panel_2 = Panel(item_4)
number_slider = Slider(0.0001, range=0..0.01)
number_slider_2 = Slider(1280, range=0..10000)
number_slider_3 = Slider(1024, range=0..10000)
c__transformcameras = CSharpScript(
    FocalLengthXPx=item,
    OpticalCenterXPx=item_6,
    OpticalCenterYPx=item_5,
    ImgWidth=number_slider_2,
    ImgHeight=number_slider_3,
    ScaleFactor=number_slider,
    CameraTransform=item_8)  # -> out, CameraPreviewGeom, ImgFrame, CameraPosition, CameraTarget, CameraDir; inputs FocalLengthXPx: Double, OpticalCenterXPx: Double, OpticalCenterYPx: Double, ImgWidth: Int32, ImgHeight: Int32, ScaleFactor: Double, CameraTransform: Transform
# ---------- c__transformcameras: C# ----------
// Grasshopper Script Instance
#region Usings
using System;
using System.Linq;
using System.Collections;
using System.Collections.Generic;
using System.Drawing;

using Rhino;
using Rhino.Geometry;

using Grasshopper;
using Grasshopper.Kernel;
using Grasshopper.Kernel.Data;
using Grasshopper.Kernel.Types;
#endregion

public class Script_Instance : GH_ScriptInstance
{
    #region Notes
    /* 
      Members:
        RhinoDoc RhinoDocument
        GH_Document GrasshopperDocument
        IGH_Component Component
        int Iteration

      Methods (Virtual & overridable):
        Print(string text)
        Print(string format, params object[] args)
        Reflect(object obj)
        Reflect(object obj, string method_name)
    */
    #endregion

    private void RunScript(
		double FocalLengthXPx,
		double OpticalCenterXPx,
		double OpticalCenterYPx,
		int ImgWidth,
		int ImgHeight,
		double ScaleFactor,
		Transform CameraTransform,
		ref object CameraPreviewGeom,
		ref object ImgFrame,
		ref object CameraPosition,
		ref object CameraTarget,
		ref object CameraDir)
    {
        Rectangle3d rect = new Rectangle3d(Plane.WorldXY, Plane.WorldXY.Origin, new Point3d(ImgWidth, ImgHeight, 0));
        Vector3d tX = Vector3d.XAxis * -1 * OpticalCenterXPx;
        Vector3d tY = Vector3d.YAxis * -1 * OpticalCenterYPx;
        Vector3d tZ = Vector3d.ZAxis * -1 * FocalLengthXPx;
        Vector3d t = tX + tY + tZ;
        Print(t.ToString());
        Transform translate = Transform.Translation(t);
        rect.Transform(translate);
        Point3d o = Plane.WorldXY.Origin;
        Line e0 = new Line(o, rect.Corner(0));
        Line e1 = new Line(o, rect.Corner(1));
        Line e2 = new Line(o, rect.Corner(2));
        Line e3 = new Line(o, rect.Corner(3));
        Line cam = new Line(o, tZ);
        List<Line> previewGeom = new List<Line>(){e0, e1, e2, e3, cam};
        Transform scale = Transform.Scale(o, ScaleFactor);

        rect.Transform(scale);
        rect.Transform(CameraTransform);

        previewGeom = TransformLines(previewGeom, scale);// previewGeom.ForEach(x => x.Transform(scale));
        previewGeom = TransformLines(previewGeom, CameraTransform);//previewGeom.ForEach(x => x.Transform(CameraTransform));
        Point3d cP = previewGeom[4].From;
        Point3d cT = previewGeom[4].To;
        Vector3d cD = cT - cP;
        cD.Unitize();

        CameraPreviewGeom = previewGeom;
        ImgFrame = rect;
        CameraPosition = cP;
        CameraTarget = cT;
        CameraDir = cD;
    }


    private List<Line> TransformLines(List<Line> lines, Transform t)
    {
        List<Line> transformed = new List<Line>();
        foreach(var line in lines)
        {
            line.Transform(t);
            transformed.Add(line);
        }
        return transformed;
    }
}
# ---------- end c__transformcameras ----------
c__samplexys = CSharpScript(ImgWidth=number_slider_2, ImgHeight=number_slider_3, SampleSpacing=Slider(10, range=0..10))  # -> out, XCoords, YCoords; inputs ImgWidth: Int32, ImgHeight: Int32, SampleSpacing: Int32
# ---------- c__samplexys: C# ----------
// Grasshopper Script Instance
#region Usings
using System;
using System.Linq;
using System.Collections;
using System.Collections.Generic;
using System.Drawing;

using Rhino;
using Rhino.Geometry;
using Rhino.FileIO;

using Grasshopper;
using Grasshopper.Kernel;
using Grasshopper.Kernel.Data;
using Grasshopper.Kernel.Types;
#endregion

public class Script_Instance : GH_ScriptInstance
{
    #region Notes
    /* 
      Members:
        RhinoDoc RhinoDocument
        GH_Document GrasshopperDocument
        IGH_Component Component
        int Iteration

      Methods (Virtual & overridable):
        Print(string text)
        Print(string format, params object[] args)
        Reflect(object obj)
        Reflect(object obj, string method_name)
    */
    #endregion

    private void RunScript(
		int ImgWidth,
		int ImgHeight,
		int SampleSpacing,
		ref object XCoords,
		ref object YCoords)
    {
        List<Point3d> samplePts = new List<Point3d>();
        List<int> xCoords = BuildCoordinates(SampleSpacing, ImgWidth);
        List<int> yCoords = BuildCoordinates(SampleSpacing, ImgHeight);
        XCoords = xCoords;
        YCoords = yCoords;
    }

    private List<int> BuildCoordinates(int spacing, int max)
    {
        List<int> coords = new List<int>();
        for (int i = 0; i < max; i += spacing)
        {
            coords.Add(i);
        }
        return coords;
    }
}
# ---------- end c__samplexys ----------
py3_sampledepthimg = Python3Script(path=item_2, XCoords=c__samplexys.XCoords, YCoords=c__samplexys.YCoords)  # -> out, Values; inputs path: String, XCoords: list of Int32, YCoords: list of Int32
# ---------- py3_sampledepthimg: Python ----------
# r: opencv-python
# r: numpy

import cv2
import numpy as np

image = cv2.imread(path, cv2.IMREAD_UNCHANGED) 
arr = np.array(image)

print(arr.shape)

Values = []
for y in YCoords:
    for x in XCoords:
        Values.append(arr[y,x].item())
# ---------- end py3_sampledepthimg ----------
c__samplerect = CSharpScript(
    Rect=c__transformcameras.ImgFrame,
    XSamples=c__samplexys.XCoords,
    YSamples=c__samplexys.YCoords,
    ImgWidth=number_slider_2,
    ImgHeight=number_slider_3)  # -> out, SamplePts; inputs Rect: Rectangle3d, XSamples: list of Int32, YSamples: list of Int32, ImgWidth: Int32, ImgHeight: Int32
# ---------- c__samplerect: C# ----------
// Grasshopper Script Instance
#region Usings
using System;
using System.Linq;
using System.Collections;
using System.Collections.Generic;
using System.Drawing;

using Rhino;
using Rhino.Geometry;
using Rhino.FileIO;

using Grasshopper;
using Grasshopper.Kernel;
using Grasshopper.Kernel.Data;
using Grasshopper.Kernel.Types;
#endregion

public class Script_Instance : GH_ScriptInstance
{
    #region Notes
    /* 
      Members:
        RhinoDoc RhinoDocument
        GH_Document GrasshopperDocument
        IGH_Component Component
        int Iteration

      Methods (Virtual & overridable):
        Print(string text)
        Print(string format, params object[] args)
        Reflect(object obj)
        Reflect(object obj, string method_name)
    */
    #endregion

    private void RunScript(
		Rectangle3d Rect,
		List<int> XSamples,
		List<int> YSamples,
		int ImgWidth,
		int ImgHeight,
		ref object SamplePts)
    {
        List<Point3d> samplePts = new List<Point3d>();
        foreach(int y in YSamples)
        {
            foreach(int x in XSamples)
            {
                double rectXParam = (double) x / (double) ImgWidth;
                double rectYParam = 1 - (double) y / (double) ImgHeight;
                samplePts.Add(Rect.PointAt(rectXParam, rectYParam));
            }
        }
        SamplePts = samplePts;
    }
}
# ---------- end c__samplerect ----------
path_2 = FilePath("G:\My Drive\GSD_AI\05_Segmentation\17DRP5sb8fy\SAM\ImageClassifications_collected.csv")
depth_factor_matterport_spec_is_4000 = Slider(4200, range=0..5000)
c__classification_csv_import = CSharpScript(FilePath=path_2)  # -> out, OrigImgPaths, Descriptions, Families, Categories, Materials, ErrorLines; inputs FilePath: String
# ---------- c__classification_csv_import: C# ----------
// Grasshopper Script Instance
#region Usings
using System;
using System.Linq;
using System.Collections;
using System.Collections.Generic;
using System.Drawing;
using System.IO;

using Rhino;
using Rhino.Geometry;

using Grasshopper;
using Grasshopper.Kernel;
using Grasshopper.Kernel.Data;
using Grasshopper.Kernel.Types;
#endregion

public class Script_Instance : GH_ScriptInstance
{
    #region Notes
    /* 
      Members:
        RhinoDoc RhinoDocument
        GH_Document GrasshopperDocument
        IGH_Component Component
        int Iteration

      Methods (Virtual & overridable):
        Print(string text)
        Print(string format, params object[] args)
        Reflect(object obj)
        Reflect(object obj, string method_name)
    */
    #endregion

    private void RunScript(
		string FilePath,
		ref object OrigImgPaths,
		ref object Descriptions,
		ref object Families,
		ref object Categories,
		ref object Materials,
		ref object ErrorLines)
    {
        List<string> lines = File.ReadLines(FilePath).ToList();
        List<string> origImgPaths = new List<string>();
        List<string> descriptions= new List<string>();
        List<string> families = new List<string>();
        List<string> categories = new List<string>();
        List<string> materials = new List<string>();

        List<string> errorLines = new List<string>();

        for(int i = 0; i < lines.Count; i++)
        {
            string line = lines[i];
            try
            {
                string[] items = line.Split(',');
                if (items.Length != 5)
                {
                    errorLines.Add(line);
                    Print($"Skipping line {i}, fragment count = {items.Length}");
                    continue;
                }
                origImgPaths.Add(items[0]);
                descriptions.Add(items[1]);
                families.Add(CleanText(items[2]));
                categories.Add(CleanText(items[3]));
                materials.Add(CleanText(items[4]));
            }
            catch(Exception e)
            {
                errorLines.Add(line);
                Print(e.Message);
            }

        }
        OrigImgPaths = origImgPaths;
        Descriptions = descriptions;
        Families = families;
        Categories = categories;
        Materials = materials;
        ErrorLines = errorLines;
    }

    //cleans up text in the CSV
    private string CleanText(string original)
    {
        string mod = new string(original.Where(c => !char.IsPunctuation(c)).ToArray());
        mod = new string(mod.Where(c => !char.IsWhiteSpace(c)).ToArray());
        return mod.ToLower();
    }
}
# ---------- end c__classification_csv_import ----------
panel_3 = Panel(path_2)
panel_4 = Panel("\"[concrete, metal, wood, brick, glass, quartz, granite, stone, gypsum, plastic, tile, carpet, other]\"")
# depth map has issues with windows, glass
c__projectdepth = CSharpScript(
    PixelPts=c__samplerect.SamplePts,
    CameraPos=graft(c__transformcameras.CameraPosition),
    GrayVals=py3_sampledepthimg.Values,
    DepthFactor=depth_factor_matterport_spec_is_4000,
    ZDir=graft(c__transformcameras.CameraDir))  # -> out, ProjectedPts, CullingIndices; inputs PixelPts: list of Point3d, CameraPos: Point3d, GrayVals: list of Int32, DepthFactor: Double, ZDir: Vector3d
# ---------- c__projectdepth: C# ----------
// Grasshopper Script Instance
#region Usings
using System;
using System.Linq;
using System.Collections;
using System.Collections.Generic;
using System.Drawing;

using Rhino;
using Rhino.Geometry;

using Grasshopper;
using Grasshopper.Kernel;
using Grasshopper.Kernel.Data;
using Grasshopper.Kernel.Types;
#endregion

public class Script_Instance : GH_ScriptInstance
{
    #region Notes
    /* 
      Members:
        RhinoDoc RhinoDocument
        GH_Document GrasshopperDocument
        IGH_Component Component
        int Iteration

      Methods (Virtual & overridable):
        Print(string text)
        Print(string format, params object[] args)
        Reflect(object obj)
        Reflect(object obj, string method_name)
    */
    #endregion

    private void RunScript(
		List<Point3d> PixelPts,
		Point3d CameraPos,
		List<int> GrayVals,
		double DepthFactor,
		Vector3d ZDir,
		ref object ProjectedPts,
		ref object CullingIndices)
    {
        var projectedPts = new List<Point3d>();
        var cullingIndices = new List<int>();
        if (PixelPts.Count != GrayVals.Count)
        {
            return;
        }

        for (int i = 0; i < PixelPts.Count; i++)
        {
            projectedPts.Add(ProjectPoint(PixelPts[i], CameraPos, GrayVals[i], DepthFactor, ZDir));
            if (GrayVals[i] != 0)continue;
            cullingIndices.Add(i);
        }

        CullingIndices = cullingIndices;
        ProjectedPts = projectedPts;
    }

    private Point3d ProjectPoint(Point3d pixelPt, Point3d cameraPos, int grayVal, double depthFactor, Vector3d zDir)
    {
        Vector3d projectionDir = pixelPt - cameraPos;
        projectionDir.Unitize();


        double zDepth =  grayVal / depthFactor;

        double angle = Vector3d.VectorAngle(zDir * -1, projectionDir);


        double projectionDepth = zDepth / Math.Cos(angle) * -1;


        Vector3d projectionVec = projectionDir * projectionDepth;


        return pixelPt + projectionVec;
    }
}
# ---------- end c__projectdepth ----------
panel_5 = Panel("""0
0
0
0
0""")
c__cull_nonexistent_classes = CSharpScript(
    OrigImgPaths=c__classification_csv_import.OrigImgPaths,
    Descriptions=c__classification_csv_import.Descriptions,
    Classifications=c__classification_csv_import.Materials,
    AcceptableClassifications=panel_4)  # -> out, CulledDescriptions, CulledOrigImgPaths, CulledClassifications; inputs OrigImgPaths: list of String, Descriptions: list of String, Classifications: list of String, AcceptableClassifications: String
# ---------- c__cull_nonexistent_classes: C# ----------
// Grasshopper Script Instance
#region Usings
using System;
using System.Linq;
using System.Collections;
using System.Collections.Generic;
using System.Drawing;

using Rhino;
using Rhino.Geometry;

using Grasshopper;
using Grasshopper.Kernel;
using Grasshopper.Kernel.Data;
using Grasshopper.Kernel.Types;
#endregion

public class Script_Instance : GH_ScriptInstance
{
    #region Notes
    /* 
      Members:
        RhinoDoc RhinoDocument
        GH_Document GrasshopperDocument
        IGH_Component Component
        int Iteration

      Methods (Virtual & overridable):
        Print(string text)
        Print(string format, params object[] args)
        Reflect(object obj)
        Reflect(object obj, string method_name)
    */
    #endregion

    private void RunScript(
		List<string> OrigImgPaths,
		List<string> Descriptions,
		List<string> Classifications,
		string AcceptableClassifications,
		ref object CulledDescriptions,
		ref object CulledOrigImgPaths,
		ref object CulledClassifications)
    {
        if (OrigImgPaths.Count != Classifications.Count || OrigImgPaths.Count != Descriptions.Count) return;

        List<string> culledImgPaths = new List<string>();
        List<string> culledClassifications = new List<string>();
        List<string> culledDescriptions = new List<string>();
        for (int i = 0; i < OrigImgPaths.Count; i++)
        {
            if (!AcceptableClassifications.Contains(Classifications[i])) continue;
            culledImgPaths.Add(OrigImgPaths[i]);
            culledClassifications.Add(Classifications[i]);
            culledDescriptions.Add(Descriptions[i]);
        }

        CulledOrigImgPaths = culledImgPaths;
        CulledClassifications = culledClassifications;
        CulledDescriptions = culledDescriptions;
    }
}
# ---------- end c__cull_nonexistent_classes ----------
lng = ListLength(List=c__cull_nonexistent_classes.CulledDescriptions)
path_3 = ConstructPath(Indices=panel_5)
series = Series(Start=0, Step=1, Count=lng)
item_9 = ListItem(List=series, Index=Slider(8959, range=0..8959), Wrap=False)
item_10 = ListItem(List=c__cull_nonexistent_classes.CulledDescriptions, Index=item_9, Wrap=True)
item_11 = ListItem(List=c__cull_nonexistent_classes.CulledOrigImgPaths, Index=item_9, Wrap=True)
c__maskimgpaths = CSharpScript(
    OrigImgPath=item_11,
    NameTrim="/content/drive/MyDrive",
    InsertPath="G:\My Drive",
    OutlinesDirName="outlines",
    MasksDirName="masks",
    MaskExtension="png",
    OutlineExtension="jpg")  # -> out, MaskImgPath, OutlineImgPath, BaseImgName, KeyedName; inputs OrigImgPath: String, NameTrim: String, InsertPath: String, OutlinesDirName: String, MasksDirName: String, MaskExtension: String, OutlineExtension: String
# ---------- c__maskimgpaths: C# ----------
// Grasshopper Script Instance
#region Usings
using System;
using System.Linq;
using System.Collections;
using System.Collections.Generic;
using System.Drawing;

using Rhino;
using Rhino.Geometry;

using Grasshopper;
using Grasshopper.Kernel;
using Grasshopper.Kernel.Data;
using Grasshopper.Kernel.Types;
#endregion

public class Script_Instance : GH_ScriptInstance
{
    #region Notes
    /* 
      Members:
        RhinoDoc RhinoDocument
        GH_Document GrasshopperDocument
        IGH_Component Component
        int Iteration

      Methods (Virtual & overridable):
        Print(string text)
        Print(string format, params object[] args)
        Reflect(object obj)
        Reflect(object obj, string method_name)
    */
    #endregion

    private void RunScript(
		string OrigImgPath,
		string NameTrim,
		string InsertPath,
		string OutlinesDirName,
		string MasksDirName,
		string MaskExtension,
		string OutlineExtension,
		ref object MaskImgPath,
		ref object OutlineImgPath,
		ref object BaseImgName,
		ref object KeyedName)
    {
        if (!OrigImgPath.Contains(NameTrim))
        {
            Print("unexpected name");
            return;
        }
        string[] frags = OrigImgPath.Split(NameTrim, StringSplitOptions.None);
        if (frags.Length != 2)
        {
            Print("failed to split name");
            return;
        }

        string modImgPath = InsertPath + frags[1];
        
        frags = modImgPath.Split(OutlinesDirName, StringSplitOptions.None);
        if (frags.Length != 2)
        {
            Print("failed to split name");
            return;
        }

        string[] frags2 = frags[1].Split('.');
        if (frags2.Length !=2)
        {
            Print("failed to get img key");
            return;
        }
        string nameKey = frags2[0];
        nameKey = nameKey.Trim('/');//remove leading '/'
    
        string modImgPathMask = frags[0] + MasksDirName + frags[1];
        string modImgPathOutline = frags[0] + OutlinesDirName + frags[1];

        frags = frags[0].Split('/');
        string baseImgName = frags[frags.Length - 2];
        BaseImgName = baseImgName;

        frags = modImgPathMask.Split('.');
        if (frags.Length != 2)
        {
            Print("failed to split at extension");
            return;
        }

        MaskImgPath = frags[0] + "." + MaskExtension;
        OutlineImgPath = modImgPathOutline;
        KeyedName = baseImgName + "_" + nameKey;

    }
}
# ---------- end c__maskimgpaths ----------
item_12 = ListItem(List=c__cull_nonexistent_classes.CulledClassifications, Index=item_9, Wrap=True)
culled_classifications = Panel(item_12)
tsort = SortText(Keys=item_12, Culture=127)  # -> Keys, Values
dcon = DeleteConsecutive(Set=tsort.Keys, Wrap=False)  # -> Set, Count
unique_classes = Panel(dcon.Set)
panel_6 = Panel(c__maskimgpaths.MaskImgPath)
c__masksample = CSharpScript(Path=c__maskimgpaths.MaskImgPath, XCoords=c__samplexys.XCoords, YCoords=c__samplexys.YCoords)  # -> out, IsInMask; inputs Path: String, XCoords: list of Int32, YCoords: list of Int32
# ---------- c__masksample: C# ----------
// Grasshopper Script Instance
#region Usings
using System;
using System.Linq;
using System.Collections;
using System.Collections.Generic;
using System.Drawing;

using Rhino;
using Rhino.Geometry;

using Grasshopper;
using Grasshopper.Kernel;
using Grasshopper.Kernel.Data;
using Grasshopper.Kernel.Types;
#endregion

public class Script_Instance : GH_ScriptInstance
{
    #region Notes
    /* 
      Members:
        RhinoDoc RhinoDocument
        GH_Document GrasshopperDocument
        IGH_Component Component
        int Iteration

      Methods (Virtual & overridable):
        Print(string text)
        Print(string format, params object[] args)
        Reflect(object obj)
        Reflect(object obj, string method_name)
    */
    #endregion

    private void RunScript(
		string Path,
		List<int> XCoords,
		List<int> YCoords,
		ref object IsInMask)
    {

        List<bool> isInMask = new List<bool>();
        Bitmap img = new Bitmap(Path);
        foreach(int y in YCoords)
        {
            foreach(int x in XCoords)
            {
                System.Drawing.Color c = img.GetPixel(x, y);
                isInMask.Add(c.R != 0 || c.G != 0 || c.B != 0);
            }
        }
        IsInMask = isInMask;
        //Colors = colors;
    }
}
# ---------- end c__masksample ----------

c__gettextures = CSharpScript(InputMeshLayer="OrigMeshes")  # -> out, Meshes, Guids, Materials; inputs InputMeshLayer: String
# ---------- c__gettextures: C# usings ----------
using Rhino.DocObjects;
using Rhino.Render;
# ---------- c__gettextures: C# ----------
    RhinoDoc doc = RhinoDoc.ActiveDoc;
    List<Mesh> meshes = new List<Mesh>();
    List<object> materials = new List<object>();
    List<string> guids = new List<string>();


    RhinoObject[] meshObjects = doc.Objects.FindByLayer(InputMeshLayer);

    int i = -1;
    foreach(RhinoObject o in meshObjects)
    {
      i++;
      Mesh[] mesh = o.GetMeshes(MeshType.Any);
      if (mesh == null || mesh.Length != 1) continue;

      Material m = o.GetMaterial(true);
      if (m == null) continue;

      //      Texture t = m.GetBitmapTexture();
      //      if (t == null || t.FileReference == null) continue;

      meshes.Add(mesh[0]);
      guids.Add(o.Id.ToString());
      materials.Add(m.Id);
    }

    Meshes = meshes;
    Materials = materials;
    Guids = guids;
# ---------- end c__gettextures ----------
mesh = Mesh(c__gettextures.Meshes)
c__meshdividebylabel2 = CSharpScript(Meshes=mesh, UniqueClasses=unique_classes)  # -> out, FinalMeshes, MeshLabels, SourceMeshIndices; inputs Meshes: list of Mesh, LabeledMeshFaces: tree of String, UniqueClasses: list of String; disabled
# ---------- c__meshdividebylabel2: C# ----------
// Grasshopper Script Instance
#region Usings
using System;
using System.Linq;
using System.Collections;
using System.Collections.Generic;
using System.Drawing;

using Rhino;
using Rhino.Geometry;

using Grasshopper;
using Grasshopper.Kernel;
using Grasshopper.Kernel.Data;
using Grasshopper.Kernel.Types;
#endregion

public class Script_Instance : GH_ScriptInstance
{
    #region Notes
    /* 
      Members:
        RhinoDoc RhinoDocument
        GH_Document GrasshopperDocument
        IGH_Component Component
        int Iteration

      Methods (Virtual & overridable):
        Print(string text)
        Print(string format, params object[] args)
        Reflect(object obj)
        Reflect(object obj, string method_name)
    */
    #endregion

    private void RunScript(
	List<Mesh> Meshes,
	DataTree<string> LabeledMeshFaces,
	List<string> UniqueClasses,
	ref object FinalMeshes,
	ref object MeshLabels,
	ref object SourceMeshIndices)
    {
        List<int>[,] faceIndicesPerMeshPerMaterial = new List<int>[Meshes.Count, UniqueClasses.Count];
        foreach(var path in LabeledMeshFaces.Paths)
        {
            if (path.Indices.Length != 2)
            {
                Print("Unexpected path format");
                return;
            }
            int meshIdx = path.Indices[0];
            int faceIdx = path.Indices[1];
            if (meshIdx == -1 || faceIdx == -1) continue;
            var branch = LabeledMeshFaces.Branch(path);
            if (branch.Count != 1)
            {
                Print("Unexpected branch length");
                return;
            }
            string label = branch[0];
            int labelIdx = UniqueClasses.IndexOf(label);
            if (faceIndicesPerMeshPerMaterial[meshIdx, labelIdx] == null) faceIndicesPerMeshPerMaterial[meshIdx, labelIdx] = new List<int>();
            if (!faceIndicesPerMeshPerMaterial[meshIdx, labelIdx].Contains(faceIdx)) faceIndicesPerMeshPerMaterial[meshIdx, labelIdx].Add(faceIdx);
        }
        List<Mesh> finalMeshes = new List<Mesh>();
        List<string> meshLabels = new List<string>();
        List<int> sourceMeshIndices = new List<int>();
        for (int m = 0; m < Meshes.Count; m++)
        {
            for (int c = 0; c < UniqueClasses.Count; c++)
            {
                Mesh tmp = Meshes[m].DuplicateMesh();
                if (faceIndicesPerMeshPerMaterial[m, c] == null) continue;
                Mesh extracted = tmp.Faces.ExtractFaces(faceIndicesPerMeshPerMaterial[m, c]);
                finalMeshes.Add(extracted);
                meshLabels.Add(UniqueClasses[c]);
                sourceMeshIndices.Add(m);
            }
        }

        FinalMeshes = finalMeshes;
        MeshLabels = meshLabels;
        SourceMeshIndices = sourceMeshIndices;
    }

    private Mesh GetSubMesh(Mesh m, List<int> faceIds)
    {
        var m2 = m.DuplicateMesh();
        return m2.Faces.ExtractFaces(faceIds);
    }
}
# ---------- end c__meshdividebylabel2 ----------
c__settextures = CSharpScript(
    Meshes=c__meshdividebylabel2.FinalMeshes,
    MeshLabels=c__meshdividebylabel2.MeshLabels,
    SourceMeshIndices=c__meshdividebylabel2.SourceMeshIndices,
    MaterialIds=c__gettextures.Materials,
    OutLayerName="ClassifiedRenderMeshes")  # -> out, a; inputs Meshes: list of Mesh, MeshLabels: list of String, SourceMeshIndices: list of Int32, MaterialIds: list of String, OutLayerName: String; disabled
# ---------- c__settextures: C# ----------
// Grasshopper Script Instance
#region Usings
using System;
using System.Linq;
using System.Collections;
using System.Collections.Generic;
using System.Drawing;

using Rhino;
using Rhino.DocObjects;
using Rhino.Geometry;

using Grasshopper;
using Grasshopper.Kernel;
using Grasshopper.Kernel.Data;
using Grasshopper.Kernel.Types;
#endregion

public class Script_Instance : GH_ScriptInstance
{
    #region Notes
    /* 
      Members:
        RhinoDoc RhinoDocument
        GH_Document GrasshopperDocument
        IGH_Component Component
        int Iteration

      Methods (Virtual & overridable):
        Print(string text)
        Print(string format, params object[] args)
        Reflect(object obj)
        Reflect(object obj, string method_name)
    */
    #endregion

    private void RunScript(
	List<Mesh> Meshes,
	List<string> MeshLabels,
	List<int> SourceMeshIndices,
	List<string> MaterialIds,
	string OutLayerName,
	ref object a)
    {
        if (Meshes.Count != SourceMeshIndices.Count || Meshes.Count != MeshLabels.Count) return;
        Layer layer = RhinoDoc.ActiveDoc.Layers.FindName(OutLayerName);
        int layerIdx;
        if (layer == null)
        {
            layerIdx = RhinoDoc.ActiveDoc.Layers.Add(OutLayerName, System.Drawing.Color.Black);
            layer = RhinoDoc.ActiveDoc.Layers.FindName(OutLayerName);
        }
        else layerIdx = layer.Index;
        for (int i = 0; i < Meshes.Count; i++)
        {
            Guid matId = new Guid(MaterialIds[SourceMeshIndices[i]]);
            int bakeLayerIdx = -1;
            var children = layer.GetChildren();
            string label = MeshLabels[i];
            if (children != null && children.Length > 0)
            {
                foreach(var c in children)
                {
                    if (c.Name == label)
                    {
                        bakeLayerIdx = c.Index;
                        break;
                    }
                }
            }
            if (bakeLayerIdx == -1)
            {
                Layer bakeLayer = new Layer();
                bakeLayer.ParentLayerId = layer.Id;
                bakeLayer.Name = label;
                bakeLayerIdx = RhinoDoc.ActiveDoc.Layers.Add(bakeLayer);
            }


            ObjectAttributes att = new ObjectAttributes();
            att.LayerIndex = bakeLayerIdx;

            Guid id = RhinoDoc.ActiveDoc.Objects.AddMesh(Meshes[i], att);
            RhinoObject addedMesh = RhinoDoc.ActiveDoc.Objects.FindId(id);
            if (addedMesh == null)
            {
            Print("could not find added mesh");
            return;
            }

            addedMesh.RenderMaterial = RhinoDoc.ActiveDoc.Materials.FindId(matId).RenderMaterial;
            addedMesh.CommitChanges();
        }
    }
}
# ---------- end c__settextures ----------

c__cullirrelevant = CSharpScript(
    ProjectedPts=c__projectdepth.ProjectedPts,
    Meshes=mesh,
    MaxDist=Slider(0.5, range=0..2),
    CameraPos=graft(c__transformcameras.CameraPosition))  # -> out, NearestMeshIds, NearestMeshPts, NearestMeshFaceIds, CullingIndices; inputs ProjectedPts: list of Point3d, Meshes: list of Mesh, MaxDist: Double, CameraPos: Point3d
# ---------- c__cullirrelevant: C# ----------
// Grasshopper Script Instance
#region Usings
using System;
using System.Linq;
using System.Collections;
using System.Collections.Generic;
using System.Drawing;
using System.Linq;

using Rhino;
using Rhino.Geometry;
using Rhino.Geometry.Intersect;

using Grasshopper;
using Grasshopper.Kernel;
using Grasshopper.Kernel.Data;
using Grasshopper.Kernel.Types;
#endregion

public class Script_Instance : GH_ScriptInstance
{
    #region Notes
    /* 
      Members:
        RhinoDoc RhinoDocument
        GH_Document GrasshopperDocument
        IGH_Component Component
        int Iteration

      Methods (Virtual & overridable):
        Print(string text)
        Print(string format, params object[] args)
        Reflect(object obj)
        Reflect(object obj, string method_name)
    */
    #endregion

    private void RunScript(
		List<Point3d> ProjectedPts,
		List<Mesh> Meshes,
		double MaxDist,
		Point3d CameraPos,
		ref object NearestMeshIds,
		ref object NearestMeshPts,
		ref object NearestMeshFaceIds,
		ref object CullingIndices)
    {
        var nearestMeshIds = new List<int>();
        var nearestMeshPts = new List<Point3d>();
        var nearestMeshFaceIds = new List<int>();
        var cullingIndices = new List<int>();
        for (int i = 0; i < ProjectedPts.Count; i++)
        {
            Point3d pP = ProjectedPts[i];
            Line ray = new Line(CameraPos, pP);
            ray.Extend(0, 100);
            List<Point3d> iPts = new List<Point3d>();
            List<int[]> meshAndFaceIds = new List<int[]>();
            for (int j = 0; j < Meshes.Count; j++)
            {
                Mesh m = Meshes[j];
                var inters = Intersection.MeshLine(m, ray, out int[] faceIds);
                if (inters == null || inters.Length == 0) continue;
                iPts.AddRange(inters);
                foreach(var id in faceIds)
                {
                    meshAndFaceIds.Add(new int[] {j, id});
                }
            }
            if (iPts.Count == 0) //if point is floating somewhere it might be still relevant, eg noisy scans with holes
            {
                nearestMeshIds.Add(-1);
                nearestMeshPts.Add(Point3d.Unset);
                nearestMeshFaceIds.Add(-1);
                continue;
            }
            double minDist = MaxDist;
            Point3d minPt = Point3d.Unset;
            int closestIdx = -1;
            for (int j = 0; j < iPts.Count; j++)
            {
                Point3d iP = iPts[j];
                double d = iP.DistanceTo(pP);
                if (d < minDist)
                {
                    minDist = d;
                    minPt = iP;
                    closestIdx = j;
                }
            }
            if (minPt != Point3d.Unset) //if point was close enough to mesh to be good
            {
                var meshAndFaceId = meshAndFaceIds[closestIdx];
                nearestMeshIds.Add(meshAndFaceId[0]);
                nearestMeshPts.Add(minPt);
                nearestMeshFaceIds.Add(meshAndFaceId[1]);
                continue;
            }
            // double cameraDist = CameraPos.DistanceTo(pP);
            // if(!iPts.Any(x => x.DistanceTo(CameraPos) < cameraDist)) //intersection closer to camera than point indices possible mirror, eg
            // {
            //     Print("mirror?");
                nearestMeshIds.Add(-1);
                nearestMeshPts.Add(Point3d.Unset);
                nearestMeshFaceIds.Add(-1);
                //continue;
            //}

            cullingIndices.Add(i);
        }

        CullingIndices = cullingIndices;
        NearestMeshIds = nearestMeshIds;
        NearestMeshPts = nearestMeshPts;
        NearestMeshFaceIds = nearestMeshFaceIds;
    }
}
# ---------- end c__cullirrelevant ----------
c__projecttomesh = CSharpScript(
    CameraPos=graft(c__transformcameras.CameraPosition),
    PixelPts=simplify(c__samplerect.SamplePts),
    Meshes=mesh,
    MaxProjectionDist=Slider(50, range=0..100))  # -> out, MeshIndices, MeshFaceIds, ProjectedPts; inputs CameraPos: Point3d, PixelPts: list of Point3d, Meshes: list of Mesh, MaxProjectionDist: Double
# ---------- c__projecttomesh: C# ----------
// Grasshopper Script Instance
#region Usings
using System;
using System.Linq;
using System.Collections;
using System.Collections.Generic;
using System.Drawing;

using Rhino;
using Rhino.Geometry;
using Rhino.Geometry.Intersect;

using Grasshopper;
using Grasshopper.Kernel;
using Grasshopper.Kernel.Data;
using Grasshopper.Kernel.Types;
#endregion

public class Script_Instance : GH_ScriptInstance
{
    #region Notes
    /* 
      Members:
        RhinoDoc RhinoDocument
        GH_Document GrasshopperDocument
        IGH_Component Component
        int Iteration

      Methods (Virtual & overridable):
        Print(string text)
        Print(string format, params object[] args)
        Reflect(object obj)
        Reflect(object obj, string method_name)
    */
    #endregion

    private void RunScript(
		Point3d CameraPos,
		List<Point3d> PixelPts,
		List<Mesh> Meshes,
		double MaxProjectionDist,
		ref object MeshIndices,
		ref object MeshFaceIds,
		ref object ProjectedPts)
    {
        List<int> meshIndices = new List<int>();
        List<int> meshFaceIds = new List<int>();
        List<Point3d> projectedPts = new List<Point3d>();
        foreach(Point3d pP in PixelPts)
        {
            Line ray = new Line(CameraPos, pP - CameraPos, MaxProjectionDist);
            List<Tuple<int, int, Point3d>> meshIdxFaceIdsClosetPts = new List<Tuple<int, int, Point3d>>();
            //get closest intersection to camera among all the meshes
            for (int i = 0; i < Meshes.Count; i++)
            {
                var inters = Intersection.MeshLineSorted(Meshes[i], ray, out int[] faceIds);
                if (inters == null || inters.Length == 0) continue;
                meshIdxFaceIdsClosetPts.Add(Tuple.Create(i, faceIds[0], inters[0]));
            }
            if(meshIdxFaceIdsClosetPts.Count == 0)
            {
                meshIndices.Add(-1);
                meshFaceIds.Add(-1);
                projectedPts.Add(Point3d.Unset);
                continue;
            }
            meshIdxFaceIdsClosetPts = meshIdxFaceIdsClosetPts.OrderBy(t => t.Item3.DistanceTo(CameraPos)).ToList();
            meshIndices.Add(meshIdxFaceIdsClosetPts[0].Item1);
            meshFaceIds.Add(meshIdxFaceIdsClosetPts[0].Item2);
            projectedPts.Add(meshIdxFaceIdsClosetPts[0].Item3);
        }
        MeshIndices = meshIndices;
        MeshFaceIds = meshFaceIds;
        ProjectedPts = projectedPts;
    }
}
# ---------- end c__projecttomesh ----------
branch = TreeBranch(Tree=c__cullirrelevant.CullingIndices, Path=path_3, MaintainPaths=True)
panel_7 = Panel(branch)
sunion = SetUnion(SetA=c__projectdepth.CullingIndices, SetB=c__cullirrelevant.CullingIndices)
simplify = SimplifyTree(Tree=sunion, Front=False)
c__applymaskstofaces_singleframe = CSharpScript(
    NearestMeshIds=c__projecttomesh.MeshIndices,
    NearestMeshFaceIds=c__projecttomesh.MeshFaceIds,
    MaskLabel=item_12,
    IsInMaskList=c__masksample.IsInMask,
    CullingIndices=sunion)  # -> out, LabeledMeshIdsFaceIdsWithCt, TotalSampleCt, SkippedSampleCt; inputs NearestMeshIds: list of Int32, NearestMeshFaceIds: list of Int32, MaskLabel: String, IsInMaskList: list of Boolean, CullingIndices: list of Int32
# ---------- c__applymaskstofaces_singleframe: C# ----------
// Grasshopper Script Instance
#region Usings
using System;
using System.Linq;
using System.Collections;
using System.Collections.Generic;
using System.Drawing;

using Rhino;
using Rhino.Geometry;

using Grasshopper;
using Grasshopper.Kernel;
using Grasshopper.Kernel.Data;
using Grasshopper.Kernel.Types;
#endregion

public class Script_Instance : GH_ScriptInstance
{
    #region Notes
    /* 
      Members:
        RhinoDoc RhinoDocument
        GH_Document GrasshopperDocument
        IGH_Component Component
        int Iteration

      Methods (Virtual & overridable):
        Print(string text)
        Print(string format, params object[] args)
        Reflect(object obj)
        Reflect(object obj, string method_name)
    */
    #endregion

    private void RunScript(
		List<int> NearestMeshIds,
		List<int> NearestMeshFaceIds,
		string MaskLabel,
		List<bool> IsInMaskList,
		List<int> CullingIndices,
		ref object LabeledMeshIdsFaceIdsWithCt,
		ref object TotalSampleCt,
		ref object SkippedSampleCt)
    {
        //mesh id, face id, labels
        DataTree<int> labeledFaceIdsWithCt = new DataTree<int>();
        int totalSampleCt = 0;
        int skippedSampleCt = 0;
        if (NearestMeshIds.Count != NearestMeshFaceIds.Count || NearestMeshIds.Count != IsInMaskList.Count)
        {
            Print("list length mismatch");
            return;
        }
        for(int p = 0; p < IsInMaskList.Count; p++)
        {
            if (!IsInMaskList[p]) continue;
            totalSampleCt++;
            if (CullingIndices.Contains(p))
            {
                skippedSampleCt++;
                continue;
            }
            GH_Path outputPath = new GH_Path(new int[] {NearestMeshIds[p], NearestMeshFaceIds[p]});
            List<int> ct = labeledFaceIdsWithCt.EnsurePath(outputPath);
            if (ct.Count == 0) ct.Add(0);
            ct[0] += 1;
        }
        

        TotalSampleCt = totalSampleCt;
        SkippedSampleCt = skippedSampleCt;

        LabeledMeshIdsFaceIdsWithCt = labeledFaceIdsWithCt;
    }
}
# ---------- end c__applymaskstofaces_singleframe ----------
path_4 = FilePath("G:\My Drive\GSD_AI\05_Segmentation\17DRP5sb8fy\PreProcessedFrameData_GPT\")
# For each mesh face:
# set of labels
txt = Text(Tree({0;27;1058}: ["other"], {0;27;1066}: ["other", "other", "other", "other"], {0;27;1067}: ["other", "other", "other", "other", "other"], {0;27;1068}: ["other", "other", "other", "other", "other", "other", "other", "other", "other"], {0;27;1070}: ["other", "other"], {0;65;1122}: ["other", "other", "other"]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))
c__jsonout = CSharpScript(
    SaveDirectory=path_4,
    KeyedName=c__maskimgpaths.KeyedName,
    DepthImgPath=item_2,
    RgbImgPath=item_4,
    SegmentImgPath=item_7,
    MaskImgPath=c__maskimgpaths.MaskImgPath,
    OutlineImgPath=c__maskimgpaths.OutlineImgPath,
    CameraTransform=item_8,
    FocalLengthXPx=item,
    OpticalCenterXPx=item_6,
    OpticalCenterYPx=item_5,
    ImgWidth=number_slider_2,
    ImgHeight=number_slider_3,
    ImgScaleFactor=number_slider,
    LabeledMeshIdsFaceIdsWithCt=c__applymaskstofaces_singleframe.LabeledMeshIdsFaceIdsWithCt,
    Label=item_12,
    OriginalDescription=item_10)  # -> out, JsonStr, JsonFormatted; inputs SaveDirectory: String, KeyedName: String, DepthImgPath: String, RgbImgPath: String, SegmentImgPath: String, MaskImgPath: String, OutlineImgPath: String, CameraTransform: Transform, FocalLengthXPx: Double, OpticalCenterXPx: Double, OpticalCenterYPx: Double, ImgWidth: Int32, ImgHeight: Int32, ImgScaleFactor: Double, LabeledMeshIdsFaceIdsWithCt: tree of Int32, Label: String, OriginalDescription: String
# ---------- c__jsonout: C# ----------
// Grasshopper Script Instance
#region Usings
using System;
using System.Linq;
using System.Collections;
using System.Collections.Generic;
using System.Drawing;

using Rhino;
using Rhino.Geometry;

using Grasshopper;
using Grasshopper.Kernel;
using Grasshopper.Kernel.Data;
using Grasshopper.Kernel.Types;

using System.Text.Json;
using System.IO;
#endregion

public class Script_Instance : GH_ScriptInstance
{
    #region Notes
    /* 
      Members:
        RhinoDoc RhinoDocument
        GH_Document GrasshopperDocument
        IGH_Component Component
        int Iteration

      Methods (Virtual & overridable):
        Print(string text)
        Print(string format, params object[] args)
        Reflect(object obj)
        Reflect(object obj, string method_name)
    */
    #endregion

    private void RunScript(
		string SaveDirectory,
		string KeyedName,
		string DepthImgPath,
		string RgbImgPath,
		string SegmentImgPath,
		string MaskImgPath,
		string OutlineImgPath,
		Transform CameraTransform,
		double FocalLengthXPx,
		double OpticalCenterXPx,
		double OpticalCenterYPx,
		int ImgWidth,
		int ImgHeight,
		double ImgScaleFactor,
		DataTree<int> LabeledMeshIdsFaceIdsWithCt,
		string Label,
		string OriginalDescription,
		ref object JsonStr,
		ref object JsonFormatted)
    {
        FrameData data = new FrameData
        {
            DepthImgPath = DepthImgPath,
            RgbImgPath = RgbImgPath,
            SegmentImgPath = SegmentImgPath,
            MaskImgPath = MaskImgPath,
            OutlineImgPath = OutlineImgPath,
            CameraTransformMatrix = CameraTransform.ToDoubleArray(true),
            FocalLengthXPx = FocalLengthXPx,
            OpticalCenterXPx = OpticalCenterXPx,
            OpticalCenterYPx = OpticalCenterYPx,
            ImgWidth = ImgWidth,
            ImgHeight = ImgHeight,
            ImgScaleFactor = ImgScaleFactor,
            LabeledMeshIdsFaceIdsWithCt = TreeConversion(LabeledMeshIdsFaceIdsWithCt),
            Label = Label,
            OriginalDescription = OriginalDescription
        };


        List<FrameData> dataList = new List<FrameData>() {data};
        JsonSerializerOptions opt = new JsonSerializerOptions();
        opt.WriteIndented = true;
        string jsonFormatted = JsonSerializer.Serialize(dataList, opt);
        string jsonStr = JsonSerializer.Serialize(dataList);
        JsonFormatted = jsonFormatted;
        JsonStr = jsonStr;
        
        string path = SaveDirectory + KeyedName + ".json";
        File.WriteAllText(path, jsonStr);
    }

    private Dictionary<int, Dictionary<int, int>> TreeConversion (DataTree<int> tree)
    {
        Dictionary<int, Dictionary<int, int>> dict = new Dictionary<int, Dictionary<int, int>>();
        foreach(GH_Path path in tree.Paths)
        {
            List<int> ct = tree.Branch(path);
            if (ct.Count > 1 || path.Indices.Length != 2)
            {
                Print("error reading data tree");
                return null;
            }
            if (ct.Count == 0) continue;
            int meshIdx = path.Indices[0];
            int faceIdx = path.Indices[1];
            if (!dict.ContainsKey(meshIdx))
            {
                dict.Add(meshIdx, new Dictionary<int, int>());
            }
            if (dict[meshIdx].ContainsKey(faceIdx))
            {
                Print("key already present in face index dictionary");
                return null;
            }
            dict[meshIdx].Add(faceIdx, ct[0]);
        }

        return dict;
    }

    private class FrameData
    {
        public string DepthImgPath {get;set;}
        public string RgbImgPath {get;set;}
        public string SegmentImgPath {get;set;}
        public string MaskImgPath {get;set;}
        public string OutlineImgPath {get;set;}
        public double[] CameraTransformMatrix {get;set;}
        public double FocalLengthXPx {get;set;}
        public double OpticalCenterXPx {get;set;}
        public double OpticalCenterYPx {get;set;}
        public int ImgWidth {get;set;}
        public int ImgHeight {get;set;}
        public double ImgScaleFactor {get;set;}
        public Dictionary<int, Dictionary<int, int>> LabeledMeshIdsFaceIdsWithCt {get;set;}
        public string Label {get;set;}
        public string OriginalDescription {get;set;}
    }
}
# ---------- end c__jsonout ----------

# ---- group: Verification
c__jsonin = CSharpScript(JsonStr=c__jsonout.JsonStr)  # -> out, DepthImgPath, RgbImgPath, SegmentImgPath, MaskImgPath, OutlineImgPath, CameraTransform, FocalLengthXPx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; inputs JsonStr: String; disabled
# ---------- c__jsonin: C# ----------
// Grasshopper Script Instance
#region Usings
using System;
using System.Linq;
using System.Collections;
using System.Collections.Generic;
using System.Drawing;

using Rhino;
using Rhino.Geometry;

using Grasshopper;
using Grasshopper.Kernel;
using Grasshopper.Kernel.Data;
using Grasshopper.Kernel.Types;

using System.Text.Json;
#endregion

public class Script_Instance : GH_ScriptInstance
{
    #region Notes
    /* 
      Members:
        RhinoDoc RhinoDocument
        GH_Document GrasshopperDocument
        IGH_Component Component
        int Iteration

      Methods (Virtual & overridable):
        Print(string text)
        Print(string format, params object[] args)
        Reflect(object obj)
        Reflect(object obj, string method_name)
    */
    #endregion

    private void RunScript(
	string JsonStr,
	ref object DepthImgPath,
	ref object RgbImgPath,
	ref object SegmentImgPath,
	ref object MaskImgPath,
	ref object OutlineImgPath,
	ref object CameraTransform,
	ref object FocalLengthXPx,
	ref object OpticalCenterXPx,
	ref object OpticalCenterYPx,
	ref object ImgWidth,
	ref object ImgHeight,
	ref object ImgScaleFactor,
	ref object LabeledMeshIdsFaceIdsWithCt,
	ref object Label,
	ref object OriginalDescription)
    {
        var dataList = (List<FrameData>)JsonSerializer.Deserialize(JsonStr, typeof(List<FrameData>), new JsonSerializerOptions());
        FrameData data = dataList[0];
        DepthImgPath = data.DepthImgPath;
        RgbImgPath = data.RgbImgPath;
        SegmentImgPath = data.SegmentImgPath;
        MaskImgPath = data.MaskImgPath;
        OutlineImgPath = data.OutlineImgPath;
        CameraTransform = MatrixToTransform(data.CameraTransformMatrix);
        FocalLengthXPx = data.FocalLengthXPx;
        OpticalCenterXPx = data.OpticalCenterXPx;
        OpticalCenterYPx = data.OpticalCenterYPx;
        ImgWidth = data.ImgWidth;
        ImgHeight = data.ImgHeight;
        ImgScaleFactor = data.ImgScaleFactor;
        LabeledMeshIdsFaceIdsWithCt = DictToTree(data.LabeledMeshIdsFaceIdsWithCt);
        Label = data.Label;
        OriginalDescription = data.OriginalDescription;
    }

    private Transform MatrixToTransform(double[] transformMatrix)
    {
        Transform t = Transform.Identity;

        for(int r = 0; r < 4; r++) for(int c = 0; c < 4; c++)
        {
            int i = r * 4 + c;
            t[r, c] = transformMatrix[i];
        }

        return t;
    }

    private DataTree<int> DictToTree(Dictionary<int, Dictionary<int, int>> dict)
    {
        DataTree<int> dataTree = new DataTree<int>();
        foreach(int meshIdx in dict.Keys)
        {
            foreach(int faceIdx in dict[meshIdx].Keys)
            {
                GH_Path path = new GH_Path(new int[] {meshIdx, faceIdx});
                List<int> ct = dataTree.EnsurePath(path);
                ct.Add(dict[meshIdx][faceIdx]);//should only be one value in the target tree branch since it is a total.
            }
        }
        return dataTree;
    }

    private class FrameData
    {
        public string DepthImgPath {get;set;}
        public string RgbImgPath {get;set;}
        public string SegmentImgPath {get;set;}
        public string MaskImgPath {get;set;}
        public string OutlineImgPath {get;set;}
        public double[] CameraTransformMatrix {get;set;}
        public double FocalLengthXPx {get;set;}
        public double OpticalCenterXPx {get;set;}
        public double OpticalCenterYPx {get;set;}
        public int ImgWidth {get;set;}
        public int ImgHeight {get;set;}
        public double ImgScaleFactor {get;set;}
        public Dictionary<int, Dictionary<int, int>> LabeledMeshIdsFaceIdsWithCt {get;set;}
        public string Label {get;set;}
        public string OriginalDescription {get;set;}
    }
}
# ---------- end c__jsonin ----------
number_slider_4 = Slider(0.0001, range=0..0.01)  # disabled
number_slider_5 = Slider(1280, range=0..10000)  # disabled
number_slider_6 = Slider(1024, range=0..10000)  # disabled
c__transformcameras_2 = CSharpScript(
    FocalLengthXPx=c__jsonin.FocalLengthXPx,
    OpticalCenterXPx=c__jsonin.OpticalCenterXPx,
    OpticalCenterYPx=c__jsonin.OpticalCenterYPx,
    ImgWidth=number_slider_5,
    ImgHeight=number_slider_6,
    ScaleFactor=number_slider_4,
    CameraTransform=c__jsonin.CameraTransform)  # -> out, CameraPreviewGeom, ImgFrame, CameraPosition, CameraTarget, CameraDir; inputs FocalLengthXPx: Double, OpticalCenterXPx: Double, OpticalCenterYPx: Double, ImgWidth: Int32, ImgHeight: Int32, ScaleFactor: Double, CameraTransform: Transform; disabled
# ---------- c__transformcameras_2: C# ----------
// Grasshopper Script Instance
#region Usings
using System;
using System.Linq;
using System.Collections;
using System.Collections.Generic;
using System.Drawing;

using Rhino;
using Rhino.Geometry;

using Grasshopper;
using Grasshopper.Kernel;
using Grasshopper.Kernel.Data;
using Grasshopper.Kernel.Types;
#endregion

public class Script_Instance : GH_ScriptInstance
{
    #region Notes
    /* 
      Members:
        RhinoDoc RhinoDocument
        GH_Document GrasshopperDocument
        IGH_Component Component
        int Iteration

      Methods (Virtual & overridable):
        Print(string text)
        Print(string format, params object[] args)
        Reflect(object obj)
        Reflect(object obj, string method_name)
    */
    #endregion

    private void RunScript(
	double FocalLengthXPx,
	double OpticalCenterXPx,
	double OpticalCenterYPx,
	int ImgWidth,
	int ImgHeight,
	double ScaleFactor,
	Transform CameraTransform,
	ref object CameraPreviewGeom,
	ref object ImgFrame,
	ref object CameraPosition,
	ref object CameraTarget,
	ref object CameraDir)
    {
        Rectangle3d rect = new Rectangle3d(Plane.WorldXY, Plane.WorldXY.Origin, new Point3d(ImgWidth, ImgHeight, 0));
        Vector3d tX = Vector3d.XAxis * -1 * OpticalCenterXPx;
        Vector3d tY = Vector3d.YAxis * -1 * OpticalCenterYPx;
        Vector3d tZ = Vector3d.ZAxis * -1 * FocalLengthXPx;
        Vector3d t = tX + tY + tZ;
        Print(t.ToString());
        Transform translate = Transform.Translation(t);
        rect.Transform(translate);
        Point3d o = Plane.WorldXY.Origin;
        Line e0 = new Line(o, rect.Corner(0));
        Line e1 = new Line(o, rect.Corner(1));
        Line e2 = new Line(o, rect.Corner(2));
        Line e3 = new Line(o, rect.Corner(3));
        Line cam = new Line(o, tZ);
        List<Line> previewGeom = new List<Line>(){e0, e1, e2, e3, cam};
        Transform scale = Transform.Scale(o, ScaleFactor);

        rect.Transform(scale);
        rect.Transform(CameraTransform);

        previewGeom = TransformLines(previewGeom, scale);// previewGeom.ForEach(x => x.Transform(scale));
        previewGeom = TransformLines(previewGeom, CameraTransform);//previewGeom.ForEach(x => x.Transform(CameraTransform));
        Point3d cP = previewGeom[4].From;
        Point3d cT = previewGeom[4].To;
        Vector3d cD = cT - cP;
        cD.Unitize();

        CameraPreviewGeom = previewGeom;
        ImgFrame = rect;
        CameraPosition = cP;
        CameraTarget = cT;
        CameraDir = cD;
    }


    private List<Line> TransformLines(List<Line> lines, Transform t)
    {
        List<Line> transformed = new List<Line>();
        foreach(var line in lines)
        {
            line.Transform(t);
            transformed.Add(line);
        }
        return transformed;
    }
}
# ---------- end c__transformcameras_2 ----------

# ----
panel_8 = Panel(c__jsonin.OutlineImgPath)
